# Grasshopper definition 161210_Hackathon_DF.gh (Grasshopper 0.9.76)
# plug-ins: Python Interpreter, TT Toolbox

path = FilePath("Y:\Dropbox\000_Projects\000_AEC_Hackathon2016\AEC_Hackathon_2016.xlsx")
# Import Parameters from Excel
readxl = ReadExcelSheet(Run=Toggle(True), FilePath=path, Worksheet="1", Listen=False)  # -> UserMessages, Columns, Rows
series = Series(Start=3, Step=1, Count=23)
tbi = TreeBranchIndex(DataTree=readxl.Rows, BranchIndex=series)  # -> simplify(Branch)
item = ListItem(List=tbi, Index=1, Wrap=True)  # -> Item, Item1, Item2, Item3
max = Number(item.Item3)
min = Number(item.Item2)
dom = ConstructDomain(DomainStart=min, DomainEnd=max)
panel = Panel(dom)
count = Number(item.Item1)
panel_2 = Panel(count)
names = Text(item.Item)
subtraction = Subtraction(A=count, B=1)
range = Range(Domain=dom, Steps=subtraction)
merge = Merge(Data1=min, Data2=max)
null = NullItem(Item=range)  # -> NullFlags, InvalidFlags, Description
panel_3 = Panel(null.NullFlags)
clean = CleanTree(RemoveNulls=True, RemoveInvalid=True, RemoveEmpty=False, Tree=merge)
weave = Weave(Pattern=null.NullFlags, Stream0=range, Stream1=min, NullGaps=False)  # -> simplify(Weave)
panel_4 = Panel(weave)
panel_5 = Panel(names)
bang = ExplodeTree(Data=weave)  # -> Branch0, Branch1, Branch2, Branch3, Branch4, Branch5, Branch6, Branch7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
glazing_u_value = Slider(0, range=0..1)
glazing_u_value_2 = Slider(0, range=0..1)
comfort_setpoint = Slider(0, range=0..1)
oa_perimeter = Slider(0, range=0..1)
comfort_setpoint_2 = Slider(0, range=0..1)
comfort_setpoint_3 = Slider(0, range=0..1)
comfort_setpoint_4 = Slider(0, range=0..2)
orientation = Slider(0, range=0..2)
floor_2_floor = Slider(0, range=0..1)
p_depth = Slider(0, range=0..1)
window_height = Slider(0, range=0..1)
aspect_ratio = Slider(0, range=0..1)
aspect_ratio_2 = Slider(0, range=0..3)
of_floors = Slider(0, range=0..1)
w_w_ratio = Slider(0, range=0..2)
sill_height = Slider(0, range=0..1)
wall_r_value = Slider(0, range=0..1)
infiltration = Slider(0, range=0..1)
item_2 = ListItem(List=bang.Branch0, Index=of_floors, Wrap=True)
item_3 = ListItem(List=bang.Branch1, Index=aspect_ratio, Wrap=True)
item_4 = ListItem(List=bang.Branch2, Index=aspect_ratio_2, Wrap=True)
item_5 = ListItem(List=bang.Branch3, Index=p_depth, Wrap=True)
item_6 = ListItem(List=bang.Branch4, Index=orientation, Wrap=True)
item_7 = ListItem(List=bang.Branch5, Index=floor_2_floor, Wrap=True)
item_8 = ListItem(List=bang.Branch6, Index=w_w_ratio, Wrap=True)
item_9 = ListItem(List=bang.Branch7, Index=window_height, Wrap=True)
item_10 = ListItem(List=bang.Branch8, Index=sill_height, Wrap=True)
item_11 = ListItem(List=bang.Branch9, Index=infiltration, Wrap=True)
item_12 = ListItem(List=bang.Branch10, Index=wall_r_value, Wrap=True)
item_13 = ListItem(List=bang.Branch11, Index=wall_r_value, Wrap=True)
item_14 = ListItem(List=bang.Branch12, Index=wall_r_value, Wrap=True)
item_15 = ListItem(List=bang.Branch13, Index=wall_r_value, Wrap=True)
item_16 = ListItem(List=bang.Branch14, Index=wall_r_value, Wrap=True)
item_17 = ListItem(List=bang.Branch15, Index=glazing_u_value, Wrap=True)
item_18 = ListItem(List=bang.Branch16, Index=glazing_u_value_2, Wrap=True)
item_19 = ListItem(List=bang.Branch17, Index=oa_perimeter, Wrap=True)
item_20 = ListItem(List=bang.Branch18, Index=comfort_setpoint, Wrap=True)
item_21 = ListItem(List=bang.Branch19, Index=comfort_setpoint_2, Wrap=True)
item_22 = ListItem(List=bang.Branch20, Index=comfort_setpoint_3, Wrap=True)
item_23 = ListItem(List=bang.Branch21, Index=comfort_setpoint_3, Wrap=True)
item_24 = ListItem(List=bang.Branch22, Index=comfort_setpoint_4, Wrap=True)
rec = DataRecorder(item_2, DataLimit=-10, RecordData=False)
glazing_u_value_3 = Number(item_14)
comfort_setpoint_cooling = Number(item_22)
comfort_setpoint_heating = Number(item_23)
internal_load_perimeter = Number(item_21)
internal_load_core = Number(item_20)
shading_depth = Number(item_17)
window_height_2 = Number(item_9)
oa_perimeter_2 = Number(item_19)
roof_r_value = Number(item_13)
oa_core = Number(item_18)
sill_height_2 = Number(item_10)
glazing_vlt = Number(item_16)
glazing_shgc = Number(item_15)
of_floors_2 = Number(item_2)
wall_r_value_2 = Number(item_12)
infiltration_2 = Number(item_11)
perimeter_depth = Number(item_5)
floor_2_floor_height = Number(item_7)
orientation_2 = Number(item_6)
w_w_ratio_2 = Number(item_8)
aspect_ratio_3 = Number(item_4)
area = Number(item_3)
hvac = Number(item_24)
panel_6 = Panel("""0
3""")
panel_7 = Panel("""0
3""")
panel_8 = Panel("""0
3""")
panel_9 = Panel("""0
3""")
panel_10 = Panel("""0
3""")
panel_11 = Panel("""0
3""")
panel_12 = Panel("""0
1
3""")
panel_13 = Panel("""0
3""")
panel_14 = Panel("""0
1
3""")
panel_15 = Panel("""0
3""")
panel_16 = Panel("""0
3""")
panel_17 = Panel("""0
3""")
panel_18 = Panel("""0
3""")
panel_19 = Panel("""0
1
2
3""")
panel_20 = Panel("""0
1
3""")
panel_21 = Panel("""0
3""")
panel_22 = Panel("""0
3""")
panel_23 = Panel("""0
3""")
item_25 = ListItem(List=panel_6, Index=glazing_u_value_2, Wrap=True)
item_26 = ListItem(List=panel_7, Index=oa_perimeter, Wrap=True)
item_27 = ListItem(List=panel_8, Index=comfort_setpoint, Wrap=True)
item_28 = ListItem(List=panel_9, Index=glazing_u_value, Wrap=True)
item_29 = ListItem(List=panel_11, Index=comfort_setpoint_3, Wrap=True)
item_30 = ListItem(List=panel_10, Index=comfort_setpoint_2, Wrap=True)
item_31 = ListItem(List=panel_16, Index=window_height, Wrap=True)
item_32 = ListItem(List=panel_15, Index=of_floors, Wrap=True)
item_33 = ListItem(List=panel_17, Index=aspect_ratio, Wrap=True)
item_34 = ListItem(List=panel_18, Index=p_depth, Wrap=True)
item_35 = ListItem(List=panel_19, Index=aspect_ratio_2, Wrap=True)
item_36 = ListItem(List=panel_20, Index=w_w_ratio, Wrap=True)
item_37 = ListItem(List=panel_21, Index=infiltration, Wrap=True)
# Calculate Your Annual Utility Cost ($$$)
# Visualize Monthly Cost on a Chart
# Visualize Energy Balance
item_38 = ListItem(List=panel_14, Index=comfort_setpoint_4, Wrap=True)
item_39 = ListItem(List=panel_22, Index=sill_height, Wrap=True)
item_40 = ListItem(List=panel_13, Index=wall_r_value, Wrap=True)
item_41 = ListItem(List=panel_12, Index=orientation, Wrap=True)
item_42 = ListItem(List=panel_23, Index=floor_2_floor, Wrap=True)

# ----
# Run Open Studio
run_eplus = BooleanToggle(False)
run_eplus_2 = Boolean(run_eplus)

run_eplus_3 = BooleanToggle(False)
concat = Concatenate(
    FragmentA=item_32,
    FragmentB=item_33,
    FragmentC=item_35,
    FragmentD=item_34,
    FragmentE=item_41,
    FragmentF=item_42,
    FragmentG=item_36,
    FragmentH=item_31,
    FragmentI=item_39,
    FragmentJ=item_37,
    FragmentK=item_40,
    FragmentL=item_40,
    FragmentM=item_40,
    FragmentN=item_40,
    FragmentO=item_40,
    FragmentP=item_28,
    FragmentQ=item_25,
    FragmentR=item_26,
    FragmentS=item_27,
    FragmentT=item_30,
    FragmentU=item_29,
    FragmentV=item_29,
    FragmentW=item_38)
fly = Ladybug_fly(inputSliders=[of_floors, aspect_ratio_2, wall_r_value, w_w_ratio], fly=Button())  # -> Vviiiiiiiiiizzz; plug-in component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
ladybug = Ladybug_Ladybug()  # -> Vviiiiiiiiiizzz; plug-in component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
honeybee = Honeybee_Honeybee()  # -> Vviiiiiiiiiizzz; plug-in component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
number_slider = Slider(4, range=0..10)
number_slider_2 = Slider(9, range=0..100)
number_slider_3 = Slider(53, range=0..100)
building_area = Panel(area)
updatehoneybee = Honeybee_UpdateHoneybee(sourceDirectory="C:\Users\byron\AppData\Roaming\Grasshopper\UserObjects", updateThisFile=Toggle(False))  # -> readMe; plug-in component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
subtraction_2 = Subtraction(A=Slider(9, range=0..10), B=perimeter_depth)
num = Number(floor_2_floor_height)
division = Division(A=building_area, B=num)
sqrt = SquareRoot(Value=division)
python = PythonScript(area=division, ratio=aspect_ratio_3, depth=sqrt)  # -> a, b
# ---------- python: Python ----------
if ratio == 1:
    a = depth
    b = depth
else:
    a = ratio*int(area)/depth
    b = 1/ratio*int(area)/depth
# ---------- end python ----------
rectangle = Rectangle(Plane=PlaneXY(0, 0, 0), XSize=python.a, YSize=python.b, Radius=0)  # -> Rectangle, Length
area_2 = Area(Geometry=rectangle.Rectangle)  # -> Area, Centroid
xy = XYPlane(Origin=area_2.Centroid)
rotate = Rotate(Geometry=rectangle.Rectangle, Angle=degrees(orientation_2), Plane=xy)  # -> Geometry, Transform
crv = Curve(rotate.Geometry)
offset = Offset(Curve=crv, Distance=expr("-x", subtraction_2), Plane=PlaneXY(0, 0, 0), Corners=1)
redpline = Reduce(Polyline=offset, Tolerance=1)  # -> Polyline, Reduction
multiplication = Multiplication(A=num, B=of_floors_2)
explode = Explode(Curve=crv, Recursive=True)  # -> Segments, Vertices
explode_2 = Explode(Curve=redpline.Polyline, Recursive=True)  # -> Segments, Vertices
X = UnitX(Factor=python.a)
pt = Point(Point(0, 0, 0))
Y = UnitY(Factor=python.b)
move = Move(Geometry=pt, Motion=X)  # -> Geometry, Transform
move_2 = Move(Geometry=move.Geometry, Motion=Y)  # -> Geometry, Transform
rec_2pt = Rectangle2Pt(Plane=pt, PointA=pt, PointB=move_2.Geometry, Radius=0)  # -> Rectangle, Length
Z = UnitZ(Factor=multiplication)
boundary = BoundarySurfaces(Edges=rec_2pt.Rectangle)
graft = GraftTree(Tree=explode.Segments, IncludeEmptyLists=True, IncludeNullItems=True)  # -> simplify(Tree)
graft_2 = GraftTree(Tree=explode_2.Segments, IncludeEmptyLists=True, IncludeNullItems=True)  # -> simplify(Tree)
number_slider_4 = Slider(4, range=0..10)
extr = Extrude(Base=boundary, Direction=Z)
loft = Loft(
    Curves=[graft, graft_2],
    Options={Adjust=False, Closed=False, LoftEnds=0, LoftSimp=0, LoftType=0, Rebuild=10, Refit=0.01})
Z_2 = UnitZ(Factor=num)
boundary_2 = BoundarySurfaces(Edges=offset)
series_2 = Series(Start=0, Step=num, Count=of_floors_2)
extr_2 = Extrude(Base=flatten([loft, boundary_2]), Direction=Z_2)
splitmass = Honeybee_SplitBuildingMass(bldgMasses=extr, perimeterZoneDepth=perimeter_depth, runIt=Toggle(True))  # -> readMe, splitBldgMasses; plug-in component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
Z_3 = UnitZ(Factor=series_2)
move_3 = Move(Geometry=extr_2, Motion=graft(Z_3))  # -> flatten(Geometry), Transform
mass2zone = Honeybee_Masses2Zones(zoneMasses=flatten(move_3.Geometry), isConditioned=True, maxRoofAngle=30, createHBZones=True)  # -> readMe, HBZones; plug-in component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
solveadjc = Honeybee_SolveAdjacencies(HBZones=flatten(mass2zone.HBZones), findAdjc=Toggle(True))  # -> readMe, HBZonesWADJ; plug-in component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
glazingcreator = Honeybee_GlazingBasedOnRatio(
    HBObjects=solveadjc.HBZonesWADJ,
    glzRatio=w_w_ratio_2,
    breakUpWindow=Toggle(False),
    windowHeight=window_height_2,
    sillHeight=sill_height_2,
    runIt=Toggle(True))  # -> readMe, HBObjWGLZ; plug-in component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
decompose_honeybee_zone = Honeybee_DecomposeHBZone(HBZone=glazingcreator.HBObjWGLZ)  # -> HBSurfaces; plug-in component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
decomposebytype = Honeybee_DecomposeBasedOnType(HBZone=glazingcreator.HBObjWGLZ)  # -> walls, interiorWalls, airWalls, windows, interiorWindows, skylights, roofs, ceilings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; plug-in component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
number_slider_5 = Slider(0.5, range=0..1)
geo = Geometry(decomposebytype.windows)
radopaquematerial = Honeybee_RadianceOpaqueMaterial(
    materialName="walls",
    RReflectance=number_slider_5,
    GReflectance=number_slider_5,
    BReflectance=number_slider_5,
    roughness=0.05,
    specularity=0)  # -> avrgRef, RADMaterial; plug-in component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
radglassmaterial = Honeybee_RadianceGlassMaterial(
    materialName="glass",
    RTransmittance=glazing_vlt,
    GTransmittance=glazing_vlt,
    BTransmittance=glazing_vlt,
    refractiveIndex=1.52)  # -> avrgTrans, RADMaterial; plug-in component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
genhbzonetestpts = Honeybee_GenerateZoneTestPoints(HBZone=glazingcreator.HBObjWGLZ, gridSize=Slider(1, range=0..1), distBaseSrf=Slider(0.75, range=0..1), moveTestMesh=True)  # -> readMe, simplify(testPoints), simplify(ptsVectors), simplify(facesArea), simplify(mesh); plug-in component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
clean_2 = CleanTree(RemoveNulls=True, RemoveInvalid=True, RemoveEmpty=True, Tree=decomposebytype.windows)
createhbsrfs = Honeybee_createHBSrfs(
    geometry=[decomposebytype.walls, decomposebytype.airWalls, decomposebytype.ceilings, decomposebytype.roofs, decomposebytype.floors, decomposebytype.exposedFloors, decomposebytype.groundFloors, decomposebytype.undergroundWalls, decomposebytype.undergroundSlabs, decomposebytype.undergroundCeilings, decomposebytype.shadings],
    RADMaterial=radopaquematerial.RADMaterial)  # -> readMe, simplify(HBSurface); plug-in component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
createhbsrfs_2 = Honeybee_createHBSrfs(geometry=clean_2, RADMaterial=radglassmaterial.RADMaterial)  # -> readMe, simplify(HBSurface); plug-in component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
# Copy Weather File URL here:: Y:\Dropbox\000_Projects\000_AEC_Hackathon2016\USA_NY_New.York-LaGuardia.AP.725030_TMY3\USA_NY_New.York-LaGuardia.AP.725030_TMY3.epw
daylighfactorsimulation = Honeybee_DaylightFactorSimulation(
    testPoints=genhbzonetestpts.testPoints,
    ptsVectors=genhbzonetestpts.ptsVectors,
    testMesh=genhbzonetestpts.mesh,
    uniformSky=False)  # -> analysisRecipe; plug-in component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
askme = Honeybee_AskMe(HBObjects=createhbsrfs_2.HBSurface)  # -> readMe; plug-in component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
askme_2 = Honeybee_AskMe(HBObjects=createhbsrfs.HBSurface)  # -> readMe; plug-in component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
panel_24 = Panel(askme)
rundaylightanalysis = Honeybee_RunDaylightSimulation(
    HBObjects=flatten([createhbsrfs.HBSurface, createhbsrfs_2.HBSurface]),
    analysisRecipe=daylighfactorsimulation,
    writeRad=Toggle(True),
    runRad=Toggle(False),
    workingDir="Y:\Dropbox\000_Projects\000_AEC_Hackathon2016\DF",
    radFileName=concat,
    overwriteResults=True)  # -> readMe, analysisType, resultsUnit, results, testPts, DF_files, radGeoFile, studyFolder, done; plug-in component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
lookupfolder_daylighting = Honeybee_LookupDaylightingFolder(studyFolder=rundaylightanalysis.studyFolder)  # -> analysisType, resultsUnit, illFiles, ptsFiles, hdrFiles, imageFiles, iesFiles, epwFile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; plug-in component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
readradresults = Honeybee_ReadRADResult(
    analysisType=lookupfolder_daylighting.analysisType,
    resultFiles=lookupfolder_daylighting.illFiles,
    testPts=genhbzonetestpts.testPoints,
    writeToFile=False)  # -> readMe, unit, flatten(values); plug-in component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
mjoin = MeshJoin(Meshes=lookupfolder_daylighting.analysisMesh)
# Zone Type 0
# Visualize Schedules
# Set Material Properties
# Set Program Type
# Set Internal Loads
# Set Schedules
# Set Mech Systems
# Compile Final Model
# Set Internal Loads
# Visualize the Zones
recolormesh = Ladybug_RecolorMesh(analysisResult=readradresults.values, inputMesh=mjoin)  # -> readMe, newMesh, newLegend, legendBasePt, meshColors, legendColors; plug-in component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
