# Grasshopper definition 161210_Hackathon_IDF_creator.gh (Grasshopper 0.9.76)
# plug-ins: Python Interpreter, ItemSelector, TT Toolbox

path = FilePath("C:\Users\byron\Desktop\AEC Hackathon 2016.xlsx")
# Import Parameters from Excel
readxl = ReadExcelSheet(Run=Toggle(True), FilePath=path, Worksheet="1", Listen=False)  # -> UserMessages, Columns, Rows
series = Series(Start=3, Step=1, Count=23)
tbi = TreeBranchIndex(DataTree=readxl.Rows, BranchIndex=series)  # -> simplify(Branch)
item = ListItem(List=tbi, Index=1, Wrap=True)  # -> Item, Item1, Item2, Item3
max = Number(item.Item3)
min = Number(item.Item2)
dom = ConstructDomain(DomainStart=min, DomainEnd=max)
panel = Panel(dom)
count = Number(item.Item1)
panel_2 = Panel(count)
names = Text(item.Item)
subtraction = Subtraction(A=count, B=1)
range = Range(Domain=dom, Steps=subtraction)
merge = Merge(Data1=min, Data2=max)
null = NullItem(Item=range)  # -> NullFlags, InvalidFlags, Description
panel_3 = Panel(null.NullFlags)
clean = CleanTree(RemoveNulls=True, RemoveInvalid=True, RemoveEmpty=False, Tree=merge)
weave = Weave(Pattern=null.NullFlags, Stream0=range, Stream1=min, NullGaps=False)  # -> simplify(Weave)
panel_4 = Panel(weave)
panel_5 = Panel(names)
bang = ExplodeTree(Data=weave)  # -> Branch0, Branch1, Branch2, Branch3, Branch4, Branch5, Branch6, Branch7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
glazing_u_value = Slider(0, range=0..1)
glazing_u_value_2 = Slider(0, range=0..1)
comfort_setpoint = Slider(0, range=0..1)
oa_perimeter = Slider(0, range=0..1)
comfort_setpoint_2 = Slider(0, range=0..1)
comfort_setpoint_3 = Slider(0, range=0..1)
comfort_setpoint_4 = Slider(1, range=0..2)
orientation = Slider(0, range=0..2)
floor_2_floor = Slider(0, range=0..1)
p_depth = Slider(0, range=0..1)
window_height = Slider(0, range=0..1)
aspect_ratio = Slider(0, range=0..1)
aspect_ratio_2 = Slider(2, range=0..3)
of_floors = Slider(1, range=0..1)
w_w_ratio = Slider(1, range=0..2)
sill_height = Slider(0, range=0..1)
wall_r_value = Slider(0, range=0..1)
infiltration = Slider(0, range=0..1)
item_2 = ListItem(List=bang.Branch0, Index=of_floors, Wrap=True)
item_3 = ListItem(List=bang.Branch1, Index=aspect_ratio, Wrap=True)
item_4 = ListItem(List=bang.Branch2, Index=aspect_ratio_2, Wrap=True)
item_5 = ListItem(List=bang.Branch3, Index=p_depth, Wrap=True)
item_6 = ListItem(List=bang.Branch4, Index=orientation, Wrap=True)
item_7 = ListItem(List=bang.Branch5, Index=floor_2_floor, Wrap=True)
item_8 = ListItem(List=bang.Branch6, Index=w_w_ratio, Wrap=True)
item_9 = ListItem(List=bang.Branch7, Index=window_height, Wrap=True)
item_10 = ListItem(List=bang.Branch8, Index=sill_height, Wrap=True)
item_11 = ListItem(List=bang.Branch9, Index=infiltration, Wrap=True)
item_12 = ListItem(List=bang.Branch10, Index=wall_r_value, Wrap=True)
item_13 = ListItem(List=bang.Branch11, Index=wall_r_value, Wrap=True)
item_14 = ListItem(List=bang.Branch12, Index=wall_r_value, Wrap=True)
item_15 = ListItem(List=bang.Branch13, Index=wall_r_value, Wrap=True)
item_16 = ListItem(List=bang.Branch14, Index=wall_r_value, Wrap=True)
item_17 = ListItem(List=bang.Branch15, Index=glazing_u_value, Wrap=True)
item_18 = ListItem(List=bang.Branch16, Index=glazing_u_value_2, Wrap=True)
item_19 = ListItem(List=bang.Branch17, Index=oa_perimeter, Wrap=True)
item_20 = ListItem(List=bang.Branch18, Index=comfort_setpoint, Wrap=True)
item_21 = ListItem(List=bang.Branch19, Index=comfort_setpoint_2, Wrap=True)
item_22 = ListItem(List=bang.Branch20, Index=comfort_setpoint_3, Wrap=True)
item_23 = ListItem(List=bang.Branch21, Index=comfort_setpoint_3, Wrap=True)
item_24 = ListItem(List=bang.Branch22, Index=comfort_setpoint_4, Wrap=True)
rec = DataRecorder(item_2, DataLimit=-10, RecordData=False)
glazing_u_value_3 = Number(item_14)
of_floors_2 = Number(item_2)
area = Number(item_3)
aspect_ratio_3 = Number(item_4)
perimeter_depth = Number(item_5)
floor_2_floor_height = Number(item_7)
shading_depth = Number(item_17)
oa_core = Number(item_18)
oa_perimeter_2 = Number(item_19)
internal_load_core = Number(item_20)
internal_load_perimeter = Number(item_21)
comfort_setpoint_cooling = Number(item_22)
comfort_setpoint_heating = Number(item_23)
window_height_2 = Number(item_9)
roof_r_value = Number(item_13)
sill_height_2 = Number(item_10)
glazing_vlt = Number(item_16)
orientation_2 = Number(item_6)
glazing_shgc = Number(item_15)
infiltration_2 = Number(item_11)
w_w_ratio_2 = Number(item_8)
wall_r_value_2 = Number(item_12)
hvac = Number(item_24)
panel_6 = Panel("""0
3""")
panel_7 = Panel("""0
3""")
panel_8 = Panel("""0
3""")
panel_9 = Panel("""0
3""")
panel_10 = Panel("""0
3""")
panel_11 = Panel("""0
3""")
panel_12 = Panel("""0
1
3""")
panel_13 = Panel("""0
3""")
panel_14 = Panel("""0
1
3""")
panel_15 = Panel("""0
3""")
panel_16 = Panel("""0
3""")
panel_17 = Panel("""0
3""")
panel_18 = Panel("""0
3""")
panel_19 = Panel("""0
1
2
3""")
panel_20 = Panel("""0
1
3""")
panel_21 = Panel("""0
3""")
panel_22 = Panel("""0
3""")
panel_23 = Panel("""0
3""")
item_25 = ListItem(List=panel_6, Index=glazing_u_value_2, Wrap=True)
item_26 = ListItem(List=panel_7, Index=oa_perimeter, Wrap=True)
item_27 = ListItem(List=panel_8, Index=comfort_setpoint, Wrap=True)
item_28 = ListItem(List=panel_9, Index=glazing_u_value, Wrap=True)
item_29 = ListItem(List=panel_11, Index=comfort_setpoint_3, Wrap=True)
item_30 = ListItem(List=panel_10, Index=comfort_setpoint_2, Wrap=True)
item_31 = ListItem(List=panel_16, Index=window_height, Wrap=True)
item_32 = ListItem(List=panel_15, Index=of_floors, Wrap=True)
item_33 = ListItem(List=panel_17, Index=aspect_ratio, Wrap=True)
item_34 = ListItem(List=panel_18, Index=p_depth, Wrap=True)
item_35 = ListItem(List=panel_19, Index=aspect_ratio_2, Wrap=True)
item_36 = ListItem(List=panel_20, Index=w_w_ratio, Wrap=True)
item_37 = ListItem(List=panel_21, Index=infiltration, Wrap=True)
item_38 = ListItem(List=panel_14, Index=comfort_setpoint_4, Wrap=True)
item_39 = ListItem(List=panel_22, Index=sill_height, Wrap=True)
item_40 = ListItem(List=panel_13, Index=wall_r_value, Wrap=True)
item_41 = ListItem(List=panel_12, Index=orientation, Wrap=True)
item_42 = ListItem(List=panel_23, Index=floor_2_floor, Wrap=True)
concat = Concatenate(
    FragmentA=item_32,
    FragmentB=item_33,
    FragmentC=item_35,
    FragmentD=item_34,
    FragmentE=item_41,
    FragmentF=item_42,
    FragmentG=item_36,
    FragmentH=item_31,
    FragmentI=item_39,
    FragmentJ=item_37,
    FragmentK=item_40,
    FragmentL=item_40,
    FragmentM=item_40,
    FragmentN=item_40,
    FragmentO=item_40,
    FragmentP=item_28,
    FragmentQ=item_25,
    FragmentR=item_26,
    FragmentS=item_27,
    FragmentT=item_30,
    FragmentU=item_29,
    FragmentV=item_29,
    FragmentW=item_38)

# ----
# Run Open Studio
run_eplus = BooleanToggle(True)
run_eplus_2 = Boolean(run_eplus)

run_eplus_3 = BooleanToggle(False)
fly = Ladybug_fly(
    inputSliders=[of_floors, aspect_ratio_2, orientation, w_w_ratio, infiltration, wall_r_value, oa_perimeter, comfort_setpoint_4],
    fly=Button())  # -> Vviiiiiiiiiizzz; plug-in component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
ladybug = Ladybug_Ladybug()  # -> Vviiiiiiiiiizzz; plug-in component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
honeybee = Honeybee_Honeybee()  # -> Vviiiiiiiiiizzz; plug-in component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
buildingdepth = Number()
building_width = Number()
orientation_3 = Number()
ww = Number(w_w_ratio_2)
number_slider = Slider(4, range=0..10)
number_slider_2 = Slider(9, range=0..100)
number_slider_3 = Slider(53, range=0..100)

# ----
# Set Facade Glazing Properties
n_window_wall_ratio = Slider(0.4, range=0..1)
e_window_wall_ratio = Slider(0.4, range=0..1)
s_window_wall_ratio = Slider(0.4, range=0..1)
w_window_wall_ratio = Slider(0.4, range=0..1)
num = Number(ww)
num_2 = Number(ww)
num_3 = Number(ww)
num_4 = Number(ww)

choose_standard = ValueList({"ASHRAE 90.1 2004": 0, "ASHRAE 90.1 2007": 1, "ASHRAE 90.1 2010": 2, "ASHRAE 189.1": 3, "CBECS 1980 - 2004": 4, "CBECS before 1980": 5}, selected="ASHRAE 90.1 2010")
climate_zone = Slider(5, range=1..7)
ashrae_choice = Number(choose_standard)
climate_zone_2 = Number(climate_zone)

length_ft = Slider(212, range=0..300)
ceiling_height_ft = Slider(10, range=0..20)
floor_to_floor_height_ft = Slider(14, range=0..20)
perimeter_zone_depth_ft = Slider(15, range=0..20)
floorplate_depth_ft = Slider(212, range=0..300)
# Set Overall Model Parameters
of_floors_3 = Slider(4, range=0..20)
num_5 = Number(of_floors_3)

panel_24 = Panel("""Orient Axis
0= North
90 = East""")
orientation_4 = ControlKnob(Decimals=2, Limit=True, Maximum=360, Minimum=0, Range=360, Value=175.93)
num_6 = Number(orientation_3)

list = ValueList({"Minimal Shadowing": 0, "Full Exterior": 1, "Full Interior and Exterior": 2, "Full Exterior with Reflections": 3, "Full Interior and Exterior with Reflections": 4}, selected="Full Interior and Exterior")
list_2 = ValueList({"City": 0, "Suburbs": 1, "Country": 2, "Ocean": 3}, selected="City")

center_point = Point(Point(-0.2259105742, -0.277629172, 0))
pt = Point(center_point)

copy_weather_file_url_here = Panel("https://www.energyplus.net/weather-download/north_and_central_america_wmo_region_4/USA/NY/USA_NY_New.York-LaGuardia.AP.725030_TMY3/all")
download_weather_file = BooleanToggle(False)

solve_adjacencies = BooleanToggle(True)
add_glazing = BooleanToggle(True)
set_mech_systems = BooleanToggle(True)
bool = Boolean(solve_adjacencies)
bool_2 = Boolean(add_glazing)
bool_3 = Boolean(set_mech_systems)

# ----
# Create Model
subdivide_massing = BooleanToggle(True)
bool_4 = Boolean(subdivide_massing)

data_folder_location = Panel("\\ph-file1\Projects\43058.000\ADMIN\Disciplines\Lighting\South Concourse\daylighting\data")
folder_location = Text(data_folder_location)

list_3 = ValueList({"Hourly": "hourly", "Daily": "daily", "Monthly": "monthly", "Annual": "annual"}, selected="Hourly")

building_area = Panel(area)
swatch = ColourSwatch(SwatchColor=RGB(0, 4, 255))  # disabled
swatch_2 = ColourSwatch(SwatchColor=RGB(255, 0, 0))  # disabled
swatch_3 = ColourSwatch(SwatchColor=RGB(255, 255, 255))  # disabled
updatehoneybee = Honeybee_UpdateHoneybee(sourceDirectory="C:\Users\byron\AppData\Roaming\Grasshopper\UserObjects", updateThisFile=Toggle(False))  # -> readMe; plug-in component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
merge_2 = Merge(Data1=swatch, Data2=swatch_3, Data3=swatch_2)  # disabled
pt_2 = Point(Point(0.6647324209, 200.163685, 0))  # disabled
toggle = BooleanToggle(False)  # disabled

# ----
# Load Weather File and set EPlus Parameters
epoutput = Honeybee_GenerateEPOutput(
    zoneEnergyUse=Toggle(True),
    zoneGainsAndLosses=Toggle(True),
    zoneComfortMetrics=Toggle(False),
    comfortMapVariables=Toggle(False),
    zoneHVACParams=Toggle(False),
    surfaceTempAnalysis=Toggle(False),
    surfaceEnergyAnalysis=Toggle(False),
    glazingSolarAnalysis=Toggle(False),
    HBgeneration=Toggle(False),
    timestep=list_3)  # -> report, flatten(simulationOutputs); plug-in component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
simcontrol = Honeybee_SimulationControl(
    doZoneSizingCalculation=Toggle(True),
    doSystemSizingCalculation=Toggle(True),
    doPlantSizingCalculation=Toggle(True),
    runSimForSizingPeriods=Toggle(False),
    runSimForRunPeriods=Toggle(True))  # -> simControls; plug-in component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
analysisperiod = Ladybug_AnalysisPeriod(
    fromMonth=Slider(1, range=1..12),
    fromDay=Slider(1, range=1..31),
    fromHour=Slider(1, range=1..24),
    toMonth=Slider(12, range=1..12),
    toDay=Slider(31, range=1..31),
    toHour=Slider(24, range=1..24))  # -> readMe, analysisPeriod; plug-in component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
shadowpar = Honeybee_ShadowPar(calculationMethod="1", frequency="30", maximumFigure="3000")  # -> shadowPar; plug-in component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
downloadepw = Ladybug_downloadEPWWeatherFile(download=download_weather_file)  # -> readMe; plug-in component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

panel_25 = Panel("0")  # disabled
panel_26 = Panel(".25")  # disabled
energysimpar = Honeybee_EnergySimulationPar(timestep=6, shadowCalcPar=shadowpar, solarDistribution=list, simulationControls=simcontrol, terrain=list_2)  # -> energySimPar; plug-in component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
subtraction_2 = Subtraction(A=Slider(9, range=0..10), B=perimeter_depth)
legendpar = Ladybug_LegendParameters(customColors=flatten(merge_2))  # -> legendPar; disabled; plug-in component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
unique_title = Panel("Office")
num_7 = Number(floor_2_floor_height)
division = Division(A=building_area, B=num_7)
epw_stat = Ladybug_OpenEPWAndSTATWeatherFiles(weatherFileURL=copy_weather_file_url_here)  # -> epwFile, statFile; plug-in component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

enter_space_type_area_xx_100 = Panel("""53
47""")
enter_space_type_name = Panel("""Lab
Classroom""")
space_type_area = Number(enter_space_type_area_xx_100)

sqrt = SquareRoot(Value=division)

# ---- group: (ft)
floor_to_floor_height = Number(floor_to_floor_height_ft)
perimeter_zone_depth = Number(perimeter_zone_depth_ft)
building_width_2 = Number(length_ft)
building_depth = Number(floorplate_depth_ft)
ceiling_height = Number(ceiling_height_ft)

# ----
ma = MassAddition(Input=enter_space_type_area_xx_100)  # -> Result, PartialResults
panel_27 = Panel(ma.Result)

python = PythonScript(area=division, ratio=aspect_ratio_3, depth=sqrt)  # -> a, b
# ---------- python: Python ----------
if ratio == 1:
    a = depth
    b = depth
else:
    a = ratio*int(area)/depth
    b = 1/ratio*int(area)/depth
# ---------- end python ----------
rectangle = Rectangle(Plane=PlaneXY(0, 0, 0), XSize=python.a, YSize=python.b, Radius=0)  # -> Rectangle, Length
area_2 = Area(Geometry=rectangle.Rectangle)  # -> Area, Centroid
xy = XYPlane(Origin=area_2.Centroid)
rotate = Rotate(Geometry=rectangle.Rectangle, Angle=degrees(orientation_2), Plane=xy)  # -> Geometry, Transform
crv = Curve(rotate.Geometry)
offset = Offset(Curve=crv, Distance=expr("-x", subtraction_2), Plane=PlaneXY(0, 0, 0), Corners=1)
redpline = Reduce(Polyline=offset, Tolerance=1)  # -> Polyline, Reduction
multiplication = Multiplication(A=num_7, B=of_floors_2)
ideal_air = FilePath("c:\ladybug\2016.09.28_shoebox_test-idealAir\OpenStudio\2016.09.28_shoebox_test-idealAir\ModelToIdf\in.csv")  # disabled

division_2 = Division(A=building_width_2, B=3.26)
division_3 = Division(A=building_depth, B=3.26)
division_4 = Division(A=ceiling_height, B=3.26)
division_5 = Division(A=perimeter_zone_depth, B=3.26)
division_6 = Division(A=floor_to_floor_height, B=3.26)

panel_28 = Panel("15")  # disabled
plenum_zones = Brep()  # disabled
explode = Explode(Curve=crv, Recursive=True)  # -> Segments, Vertices
explode_2 = Explode(Curve=redpline.Polyline, Recursive=True)  # -> Segments, Vertices
X = UnitX(Factor=python.a)
pt_3 = Point(Point(0, 0, 0))
lng = ListLength(List=plenum_zones)  # disabled

# ---- group: (m)
buildingdepth_2 = Number(buildingdepth)
perimeter_zone_depth_2 = Number(division_5)
building_width_3 = Number(building_width)
ceiling_height_2 = Number(division_4)
floorto2_floor_height = Number(division_6)

# ----
Y = UnitY(Factor=python.b)
move = Move(Geometry=pt_3, Motion=X)  # -> Geometry, Transform
number_slider_4 = Slider(8, range=0..34)  # disabled
move_2 = Move(Geometry=move.Geometry, Motion=Y)  # -> Geometry, Transform
rec_2pt = Rectangle2Pt(Plane=pt_3, PointA=pt_3, PointB=move_2.Geometry, Radius=0)  # -> Rectangle, Length
Z = UnitZ(Factor=multiplication)

# ----
# Create coordinate system around center point
xy_2 = XYPlane(Origin=pt)
panel_29 = Panel("rotate plane vertically")
prot = RotatePlane(Plane=xy_2, Angle=expr("-x", degrees(num_6)))
deplane = DeconstructPlane(Plane=prot)  # -> Origin, XAxis, YAxis, ZAxis
rot3d = Rotate3D(Geometry=prot, Angle=degrees(1.570796327), Center=deplane.Origin, Axis=deplane.XAxis)  # -> Geometry, Transform
deplane_2 = DeconstructPlane(Plane=prot)  # -> Origin, XAxis, YAxis, ZAxis
origin_pt = Point(deplane_2.Origin)
x_vec = Vector(deplane_2.XAxis)
y_vec = Vector(deplane_2.YAxis)
z_vec = Vector(deplane_2.ZAxis)
rev = Reverse(Vector=z_vec)
pl = ConstructPlane(Origin=origin_pt, XAxis=y_vec, YAxis=rev)

boundary = BoundarySurfaces(Edges=rec_2pt.Rectangle)
graft = GraftTree(Tree=explode.Segments, IncludeEmptyLists=True, IncludeNullItems=True)  # -> simplify(Tree)
graft_2 = GraftTree(Tree=explode_2.Segments, IncludeEmptyLists=True, IncludeNullItems=True)  # -> simplify(Tree)
number_slider_5 = Slider(4, range=0..10)
extr = Extrude(Base=boundary, Direction=Z)
strnum = Ladybug_SeparateData()  # -> numbers, strings; disabled; plug-in component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
bnd = Bounds(Numbers=strnum.numbers)  # disabled
panel_30 = Panel(bnd)  # disabled
loft = Loft(
    Curves=[graft, graft_2],
    Options={Adjust=False, Closed=False, LoftEnds=0, LoftSimp=0, LoftType=0, Rebuild=10, Refit=0.01})

f2f_height = Number(floorto2_floor_height)
of_floors_4 = Number(num_5)
width = Number(building_width_3)
depth = Number(buildingdepth_2)

Z_2 = UnitZ(Factor=num_7)
debrep = DeconstructBrep(Brep=plenum_zones)  # -> Faces, Edges, Vertices; disabled
boundary_2 = BoundarySurfaces(Edges=offset)
series_2 = Series(Start=0, Step=num_7, Count=of_floors_2)
item_43 = ListItem(List=debrep.Faces, Index=0, Wrap=True)  # disabled

addition = Addition(A=width, B=depth, C=width, D=depth)
multiplication_2 = Multiplication(A=width, B=depth)
multiplication_3 = Multiplication(A=f2f_height, B=addition)
multiplication_4 = Multiplication(A=multiplication_2, B=of_floors_4)
multiplication_5 = Multiplication(A=of_floors_4, B=multiplication_3)
division_7 = Division(A=multiplication_4, B=multiplication_5)

splitmass = Honeybee_SplitBuildingMass(bldgMasses=extr, perimeterZoneDepth=perimeter_depth, runIt=Toggle(True))  # -> readMe, splitBldgMasses; plug-in component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
extr_2 = Extrude(Base=flatten([loft, boundary_2]), Direction=Z_2)
panel_31 = Panel("test")
Z_3 = UnitZ(Factor=series_2)
area_3 = Area(Geometry=item_43)  # -> Area, Centroid; disabled

panel_32 = Panel("Build box")
dom_2 = ConstructDomain(DomainStart=expr("-x/2", building_width_3), DomainEnd=expr("x/2", building_width_3))
dom_3 = ConstructDomain(DomainStart=expr("-x/2", buildingdepth_2), DomainEnd=expr("x/2", buildingdepth_2))
multiplication_6 = Multiplication(A=floorto2_floor_height, B=num_5)
dom_4 = ConstructDomain(DomainStart=0, DomainEnd=multiplication_6)
box = DomainBox(Base=prot, X=dom_2, Y=dom_3, Z=dom_4)

panel_33 = Panel("Output:Diagnostics,DisplayUnusedSchedules;")
swatch_4 = ColourSwatch(SwatchColor=RGB(0, 13, 255))  # disabled
swatch_5 = ColourSwatch(SwatchColor=RGB(255, 238, 0))  # disabled
swatch_6 = ColourSwatch(SwatchColor=RGB(255, 144, 0))  # disabled
ma_2 = MassAddition(Input=flatten(area_3.Area))  # -> Result, PartialResults; disabled
swatch_7 = ColourSwatch(SwatchColor=RGB(255, 0, 0))  # disabled
swatch_8 = ColourSwatch(SwatchColor=RGB(186, 186, 186))  # disabled
swatch_9 = ColourSwatch(SwatchColor=RGB(2, 3, 3))  # disabled
move_3 = Move(Geometry=extr_2, Motion=graft(Z_3))  # -> flatten(Geometry), Transform
re_run_idf = Honeybee_ReRunIDF()  # -> report, resultFileAddress; plug-in component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
toggle_2 = BooleanToggle(True)  # disabled

floor_facade_area_ratio = Number(division_7)
facade_area = Number(multiplication_5)
floor_area = Number(multiplication_4)

merge_3 = Merge(Data1=swatch_4, Data2=swatch_7, Data3=swatch_5, Data4=swatch_6, Data5=swatch_8, Data6=swatch_9)  # disabled
plenum_area_m2 = Number(ma_2.Result)  # disabled
panel_34 = Panel("1386998")  # disabled
panel_35 = Panel("20746504")  # disabled

# ----
# Set plenum and room zone heights. Set perimeter zone depth and split mass into zones.
subtraction_3 = Subtraction(A=floorto2_floor_height, B=ceiling_height_2)
concat_2 = Concatenate(FragmentC="1", FragmentA="@", FragmentB=subtraction_3)
concat_3 = Concatenate(FragmentA="@", FragmentB=perimeter_zone_depth_2)
concat_4 = Concatenate(FragmentC="1", FragmentA="@", FragmentB=ceiling_height_2)
merge_4 = Merge(Data1=concat_4, Data2=concat_2)
dup = DuplicateData(Data=merge_4, Number=num_5, Order=True)
splitmass_2 = Honeybee_SplitBuildingMass(bldgMasses=box, bldgsFlr2FloorHeights=dup, perimeterZoneDepth=concat_3, runIt=bool_4)  # -> readMe, splitBldgMasses; plug-in component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

swatch_10 = ColourSwatch(SwatchColor=RGB(255, 0, 0))  # disabled
swatch_11 = ColourSwatch(SwatchColor=RGB(149, 0, 255))  # disabled
swatch_12 = ColourSwatch(SwatchColor=RGB(186, 186, 186))  # disabled
swatch_13 = ColourSwatch(SwatchColor=RGB(255, 54, 198))  # disabled
swatch_14 = ColourSwatch(SwatchColor=RGB(0, 13, 255))  # disabled
swatch_15 = ColourSwatch(SwatchColor=RGB(2, 3, 3))  # disabled
swatch_16 = ColourSwatch(SwatchColor=RGB(255, 238, 0))  # disabled
swatch_17 = ColourSwatch(SwatchColor=RGB(255, 144, 0))  # disabled
swatch_18 = ColourSwatch(SwatchColor=RGB(58, 199, 194))  # disabled
swatch_19 = ColourSwatch(SwatchColor=RGB(156, 161, 255))  # disabled
swatch_20 = ColourSwatch(SwatchColor=RGB(245, 255, 54))  # disabled
swatch_21 = ColourSwatch(SwatchColor=RGB(186, 186, 186))  # disabled
swatch_22 = ColourSwatch(SwatchColor=RGB(0, 10, 201))  # disabled
swatch_23 = ColourSwatch(SwatchColor=RGB(255, 54, 198))  # disabled
swatch_24 = ColourSwatch(SwatchColor=RGB(127, 0, 186))  # disabled
swatch_25 = ColourSwatch(SwatchColor=RGB(2, 3, 3))  # disabled
swatch_26 = ColourSwatch(SwatchColor=RGB(255, 0, 0))  # disabled
swatch_27 = ColourSwatch(SwatchColor=RGB(255, 144, 0))  # disabled
key = Panel("""Cooling
Heating
Ligting
Equipment
Fans
Pmps""")  # disabled
panel_36 = Panel("2635348.96")  # disabled
merge_5 = Merge(
    Data1=swatch_16,
    Data2=swatch_17,
    Data3=swatch_13,
    Data4=swatch_11,
    Data5=swatch_14,
    Data6=swatch_10,
    Data7=swatch_12,
    Data8=swatch_15)  # disabled
merge_6 = Merge(
    Data1=swatch_26,
    Data2=swatch_27,
    Data3=swatch_23,
    Data4=swatch_20,
    Data5=swatch_24,
    Data6=swatch_19,
    Data7=swatch_21,
    Data8=swatch_25,
    Data9=swatch_18,
    Data10=swatch_22)  # disabled
int = Integer(0)  # disabled
panel_37 = Panel("0")  # disabled

# ----
# Split core and perimeter zones
# isolate plenum zones. Plenums are always even numbered branches.
split = SplitList(List=splitmass_2.splitBldgMasses, Index=1)  # -> simplify(ListA), simplify(ListB)
tstat = TreeStatistics(Tree=simplify(split.ListB))  # -> Paths, Length, Count
dpath = DeconstructPath(Branch=tstat.Paths)
mod = Modulus(A=dpath, B=2)
dispatch = Dispatch(List=flatten(split.ListA), DispatchPattern=[True, False])  # -> ListA, ListB
dispatch_2 = Dispatch(List=split.ListB, DispatchPattern=mod)  # -> flatten(ListA), ListB

# ----
# Create Rectangular Floorplate
massing_preview = Brep(box)
perimeter_zones = Brep(flatten(dispatch_2.ListB))
plenum_zones_2 = Brep(flatten([dispatch_2.ListA, dispatch.ListB]))
core_zones = Brep(flatten(dispatch.ListA))

number_slider_6 = Slider(0, range=0..1)  # disabled
panel_38 = Panel(".3")  # disabled
panel_39 = Panel("shade")  # disabled
epshademat = Honeybee_EnergyPlusShadeMaterial(materialName=panel_39, reflectance=panel_38, transmittance=number_slider_6)  # -> shadeMaterial; disabled; plug-in component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
toggle_3 = BooleanToggle(True)  # disabled
pt_4 = Point(Point(-0.07647287871, 101.9435147, 0))  # disabled

# ----
# Set Material Properties
callfromepconstrlibrary = Honeybee_CallFromEPConstructionLibrary()  # -> EPMaterials, EPWindowMaterils, EPConstructions; plug-in component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
panel_40 = Panel("open material library")

# ----
# gather interior wall constructions - these shoudl not really matter becuase they will be adiabatic surfaces
number_slider_7 = Slider(429, range=0..432)
split_2 = SplitList(List=callfromepconstrlibrary.EPConstructions, Index=number_slider_7)  # -> ListA, ListB

number_slider_8 = Slider(15, range=0..20)
number_slider_9 = Slider(15, range=0..20)
num_8 = Number(wall_r_value_2)
num_9 = Number(roof_r_value)
epnomassmat = Honeybee_EnergyPlusNoMassOpaqueMaterial(name="wall", R_Value=num_8)  # -> EPMaterial; plug-in component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
epnomassmat_2 = Honeybee_EnergyPlusNoMassOpaqueMaterial(name="roof", R_Value=num_9)  # -> EPMaterial; plug-in component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
toggle_4 = BooleanToggle(True)
addtoeplibrary = Honeybee_AddToEnergyPlusLibrary(EPObject=epnomassmat, addToProjectLib=toggle_4, overwrite=toggle_4)  # -> readMe; plug-in component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
toggle_5 = BooleanToggle(True)
addtoeplibrary_2 = Honeybee_AddToEnergyPlusLibrary(EPObject=epnomassmat_2, addToProjectLib=toggle_5, overwrite=toggle_5)  # -> readMe; plug-in component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

perimeter_zone_depth_3 = Number(perimeter_zone_depth_2)
floorto2_floor_height_2 = Number(floorto2_floor_height)
floor_area_2 = Number(floor_area)
facade_area_2 = Number(facade_area)

infiltration_rate_cfm_sf_facade = Panel(".25")
lpd_w_ft2 = Panel("1.28")
equipment_load_w_ft2 = Panel(".001")
ft2_per_person = Panel("1000")
cfm_person = Panel("0.001")
cfm_ft2 = Panel("1.5")

perimeter_zone_depth_4 = Number(perimeter_zone_depth_2)
floorto2_floor_height_3 = Number(floorto2_floor_height)
facade_area_3 = Number(facade_area)
floor_area_3 = Number(floor_area)

equipment_load_w_ft2_2 = Panel(".001")
ft2_per_person_2 = Panel("10000")
cfm_person_2 = Panel("0.001")

exporttoopenstudio = Honeybee_ExportToOpenStudio()  # -> readMe, osmFileAddress, idfFileAddress, resultsFileAddress, eioFileAddress, rddFileAddress, studyFolder; plug-in component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
setloadsandschedules = Honeybee_SetLoadsAndSchedules()  # -> currentSchedules, currentLoads, HBZones; plug-in component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
updatehoneybee_2 = Honeybee_UpdateHoneybee(updateAllUObjects=Toggle(True))  # -> readMe; plug-in component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
f2c = Ladybug_F2C(F=comfort_setpoint_cooling)  # -> C; plug-in component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
f2c_2 = Ladybug_F2C(F="65")  # -> C; plug-in component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
f2c_3 = Ladybug_F2C(F="80")  # -> C; plug-in component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
f2c_4 = Ladybug_F2C(F=comfort_setpoint_heating)  # -> C; plug-in component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

run = Boolean(bool)
panel_41 = Panel("Solve Adjacencies")

swatch_28 = ColourSwatch(SwatchColor=RGB(0, 0, 0))  # disabled

cooling_pump_motor_efficiency = Slider(0.85, range=0..1)
heating_supply_temp_f = Slider(180, range=0..212)
heating_eff_or_cop = Slider(0.85, range=0..8)
num_10 = Number(cooling_pump_motor_efficiency)
num_11 = Number(heating_eff_or_cop)
num_12 = Number(heating_supply_temp_f)
f2c_5 = Ladybug_F2C(F=num_12)  # -> C; plug-in component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

# ----
# Set Mech Systems
set_mech_systems_2 = Boolean(bool_3)

fan_placement = ValueList({"Draw Through": 1, "Blow Through": 0}, selected="Draw Through")  # disabled
demand_controlled_ventilation = ValueList({"Constant Volume Minimum Air": 0, "Demand Controlled Variable Minimum Air": 1}, selected="Constant Volume Minimum Air")  # disabled
airside_economizer = ValueList({"No Economizer": 0, "Differential Dry Bulb": 1, "Differential Enthalpy": 2, "Fixed Dry Bulb": 3, "Fixed Enthalpy": 4, "Electric Enthalpy": 5, "Fixed Dew Point and Dry Bulb": 6, "Differential Dry Bulb and Enthalpy": 7}, selected="Differential Dry Bulb")  # disabled
heat_recovery = ValueList({"None": 0, "Sensible": 1, "Enthalpy": 2}, selected="Enthalpy")  # disabled
fan_total_efficiency = Slider(0.7, range=0..1)  # disabled
fan_motor_efficiency = Slider(0.9, range=0..1)  # disabled
fan_pressure_rise_pa = Slider(1600, range=100..3000)  # disabled
heating_supply_air_temp_f = Slider(90, range=50..90)
cooling_supply_air_temp_f = Slider(55, range=50..90)
heat_recovery_effectiveness = Slider(0.7, range=0..1)  # disabled
f2c_6 = Ladybug_F2C(F=cooling_supply_air_temp_f)  # -> C; plug-in component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
f2c_7 = Ladybug_F2C(F=heating_supply_air_temp_f)  # -> C; plug-in component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
num_13 = Number(fan_total_efficiency)  # disabled
num_14 = Number(fan_motor_efficiency)  # disabled
num_15 = Number(fan_pressure_rise_pa)  # disabled
int_2 = Integer(fan_placement)  # disabled
int_3 = Integer(demand_controlled_ventilation)  # disabled
int_4 = Integer(airside_economizer)  # disabled
int_5 = Integer(heat_recovery)  # disabled
num_16 = Number(heat_recovery_effectiveness)  # disabled

chiller_type = ValueList({"Water Cooled": 0, "Air Cooled": 1}, selected="Water Cooled")  # disabled
cooling_cop = Slider(4, range=0..8)  # disabled
cooling_supply_temp_f = Slider(42, range=0..100)  # disabled
cooling_pump_motor_efficiency_2 = Slider(0.9, range=0..1)  # disabled
num_17 = Number(cooling_cop)  # disabled
num_18 = Number(cooling_supply_temp_f)  # disabled
num_19 = Number(cooling_pump_motor_efficiency_2)  # disabled
int_6 = Integer(chiller_type)  # disabled
f2c_8 = Ladybug_F2C(F=num_18)  # -> C; disabled; plug-in component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

pt_5 = Point(Point(-1.233299945, 359.4564215, 0))  # disabled
panel_42 = Panel("""7
12
14""")
item_44 = ListItem(List=panel_42, Index=comfort_setpoint_4, Wrap=True)

hvacsystemslist = Honeybee_HVACSystemsList({"-1. Thermostat Only": -1, "0. Ideal Air Loads": 0, "1. PTAC | Residential": 1, "2. PTHP | Residential": 2, "3. Packaged Single Zone - AC": 3, "4. Packaged Single Zone - HP": 4, "5. Packaged VAV w/ Reheat": 5, "6. Packaged VAV w/ PFP Boxes": 6, "7. VAV w/ Reheat": 7, "8. VAV w/ PFP Boxes": 8, "9. Warm Air Furnace - Gas Fired": 9, "10.Warm Air Furnace - Electric": 10, "11.Fan Coil Units + DOAS": 11, "12.Active Chilled Beams + DOAS": 12, "13.Radiant Floors + DOAS": 13, "14.VRF + DOAS": 14}, selected="7. VAV w/ Reheat")
system_type = Integer(item_44)

heatingdetails = Honeybee_HVACHeatingDetails(heatingEffOrCOP=num_11, supplyTemperature=f2c_5, pumpMotorEfficiency=num_10)  # -> heatingDetails; plug-in component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
coolingdetails = Honeybee_HVACCoolingDetails(coolingCOP=num_17, supplyTemperature=f2c_8, pumpMotorEfficiency=num_19)  # -> coolingDetails; disabled; plug-in component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
airdetails = Honeybee_HVACAirDetails()  # -> airDetails; plug-in component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

run_eplus_4 = Boolean(run_eplus_2)

# ----
# Visualize Monthly Cost on a Chart
panel_43 = Panel("1.25")  # disabled
swatch_29 = ColourSwatch(SwatchColor=RGB(245, 255, 54))  # disabled
swatch_30 = ColourSwatch(SwatchColor=RGB(255, 161, 54))  # disabled
swatch_31 = ColourSwatch(SwatchColor=RGB(0, 106, 255))  # disabled
swatch_32 = ColourSwatch(SwatchColor=RGB(255, 0, 0))  # disabled
swatch_33 = ColourSwatch(SwatchColor=RGB(168, 168, 168))  # disabled
swatch_34 = ColourSwatch(SwatchColor=RGB(82, 82, 82))  # disabled
legendpar_2 = Ladybug_LegendParameters(highBound=panel_36, customColors=flatten(merge_3), fontSize=panel_43, decimalPlaces=panel_37)  # -> legendPar; disabled; plug-in component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
panel_44 = Panel("Monthly Total Energy (kBTU)")  # disabled
panel_45 = Panel("1.5")  # disabled
toggle_6 = BooleanToggle(True)  # disabled
swatch_35 = ColourSwatch(SwatchColor=RGB(0, 0, 0))  # disabled

# ----
# Calculate Your Annual Utility Cost ($$$)
cost_of_heating_fuel_kwh = Panel("0.04")  # disabled
cost_of_electricity_kwh = Panel("0.14")  # disabled
key_2 = Panel("""Ligting
Equipment
Cooling
Heating
Fans
Pmps""")  # disabled

# ----
# Visualize Energy Balance
panel_46 = Panel("1.25")  # disabled
legendpar_3 = Ladybug_LegendParameters(customColors=flatten(merge_6), fontSize=panel_46)  # -> legendPar; disabled; plug-in component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
panel_47 = Panel("Total Monthly Energy Balance (kBTU/f2)")  # disabled
panel_48 = Panel("1.5")  # disabled
toggle_7 = BooleanToggle(True)  # disabled
swatch_36 = ColourSwatch(SwatchColor=RGB(0, 0, 0))  # disabled

# ----
# Calculate Site End-Use Intensity (EUI)
key_3 = Panel("""Ligting
Equipment
Cooling
Heating
Fans
Pmps""")  # disabled

bldgprograms = Honeybee_bldgPrograms({"Office": 0, "Retail": 1, "MidriseApartment": 2, "PrimarySchool": 3, "SecondarySchool": 4, "SmallHotel": 5, "LargeHotel": 6, "Hospital": 7, "Outpatient": 8, "Warehouse": 9, "SuperMarket": 10, "FullServiceRestaurant": 11, "QuickServiceRestaurant": 12}, selected="Office")
# Zone Type 0
# Set Program Type
zone_type_1_brep_mass = Brep(flatten(move_3.Geometry))

building_program_type = Number(bldgprograms)

panel_49 = Panel("Choose program")
listzoneprograms = Honeybee_ListZonePrograms(bldgProgram=building_program_type)  # -> OfficeZonePrograms; plug-in component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

type_1 = Honeybee_ItemSelector(
    listzoneprograms,
    {"Office::BreakRoom", "Office::Storage", "Office::Vending", "Office::OpenOffice", "Office::ClosedOffice", "Office::Conference", "Office::PrintRoom", "Office::Restroom", "Office::Elec/MechRoom", "Office::IT_Room", "Office::Stair", "Office::Corridor", "Office::Lobby"}, selected="Office::OpenOffice")

zone_masses = Brep(zone_type_1_brep_mass)
zone_program = Text(type_1)

lng_2 = ListLength(List=zone_masses)
panel_50 = Panel("Name Zones")
dup_2 = DuplicateData(Data=zone_program, Number=lng_2, Order=True)
series_3 = Series(Start=1, Step=1, Count=lng_2)
int_7 = Integer(series_3)
concat_5 = Concatenate(FragmentA=dup_2, FragmentB=int_7)

zone_masses_2 = Brep(zone_type_1_brep_mass)
run_2 = Boolean(bool_4)
zone_names = Text(concat_5)
zone_program_2 = Text(type_1)

panel_51 = Panel("Create Zones")
mass2zone = Honeybee_Masses2Zones(
    zoneMasses=flatten(zone_masses_2),
    zoneNames=zone_names,
    zonePrograms=zone_program_2,
    isConditioned=True,
    maxRoofAngle=30,
    createHBZones=run_2)  # -> readMe, HBZones; plug-in component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

list_4 = ValueList({"Wall": 0, "Roof": 1, "Floor": 2, "Ceiling": 3, "Window": 4}, selected="Roof")
list_5 = ValueList({"Wall": 0, "Roof": 1, "Floor": 2, "Ceiling": 3, "Window": 4}, selected="Floor")
list_6 = ValueList({"Wall": 0, "Roof": 1, "Floor": 2, "Ceiling": 3, "Window": 4}, selected="Wall")
climate_zone_3 = Number(climate_zone_2)
hb_zones = Brep(mass2zone.HBZones)
ashrae_choice_2 = Number(ashrae_choice)

panel_52 = Panel("Choose constructions")
searchepconstruction = Honeybee_SearchEPConstruction(
    EPConstrList=callfromepconstrlibrary.EPConstructions,
    standard=ashrae_choice_2,
    climateZone=climate_zone_3,
    surfaceType=list_4)  # -> EPSelectedConstr; plug-in component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
searchepconstruction_2 = Honeybee_SearchEPConstruction(
    EPConstrList=callfromepconstrlibrary.EPConstructions,
    standard=ashrae_choice_2,
    climateZone=climate_zone_3,
    surfaceType=list_5)  # -> EPSelectedConstr; plug-in component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
searchepconstruction_3 = Honeybee_SearchEPConstruction(
    EPConstrList=callfromepconstrlibrary.EPConstructions,
    standard=ashrae_choice_2,
    climateZone=climate_zone_3,
    surfaceType=list_6)  # -> EPSelectedConstr; plug-in component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

# ---- group: Choose material
list_7 = Honeybee_ItemSelector(
    split_2.ListB,
    {"EXTSLABCARPET 8IN CLIMATEZONE 1-8", "INTERIOR CEILING", "INTERIOR DOOR", "INTERIOR FLOOR", "INTERIOR PARTITION", "INTERIOR WALL", "INTERIOR WINDOW", "ROOF", "WALL"}, selected="EXTSLABCARPET 8IN CLIMATEZONE 1-8")
list_8 = Honeybee_ItemSelector(
    split_2.ListB,
    {"EXTSLABCARPET 8IN CLIMATEZONE 1-8", "INTERIOR CEILING", "INTERIOR DOOR", "INTERIOR FLOOR", "INTERIOR PARTITION", "INTERIOR WALL", "INTERIOR WINDOW", "ROOF", "WALL"}, selected="INTERIOR PARTITION")
list_9 = Honeybee_ItemSelector(
    split_2.ListB,
    {"EXTSLABCARPET 8IN CLIMATEZONE 1-8", "INTERIOR CEILING", "INTERIOR DOOR", "INTERIOR FLOOR", "INTERIOR PARTITION", "INTERIOR WALL", "INTERIOR WINDOW", "ROOF", "WALL"}, selected="INTERIOR DOOR")
u_value = Slider(2.84, range=0..15)
shgc = Slider(0.3, range=0..1)
vlt = Slider(0.5, range=0..1)
panel_53 = Panel("Ceiling")
panel_54 = Panel("Wall")
glass_name = Panel("InteriorGlaz1")
list_10 = Honeybee_ItemSelector(
    searchepconstruction,
    {"ASHRAE 90.1-2010 EXTROOF IEAD CLIMATEZONE 2-8", "ASHRAE 90.1-2010 EXTROOF METAL CLIMATEZONE 2-5"}, selected="ASHRAE 90.1-2010 EXTROOF METAL CLIMATEZONE 2-5")
list_11 = Honeybee_ItemSelector(
    searchepconstruction_3,
    {"ASHRAE 90.1-2010 EXTWALL MASS CLIMATEZONE 5", "ASHRAE 90.1-2010 EXTWALL MASS CLIMATEZONE ALT-RES 5", "ASHRAE 90.1-2010 EXTWALL METAL CLIMATEZONE 5-6", "ASHRAE 90.1-2010 EXTWALL STEELFRAME CLIMATEZONE 4-8", "ASHRAE 90.1-2010 EXTWALL STEELFRAME CLIMATEZONE ALT-RES 2-6", "ASHRAE 90.1-2010 EXTWALL WOODFRAME CLIMATEZONE 5"}, selected="ASHRAE 90.1-2010 EXTWALL MASS CLIMATEZONE 5")
panel_56 = Panel("Interior Constructions")
panel_57 = Panel("Glazing")
panel_58 = Panel("Floor")
panel_59 = Panel("Roof")
panel_61 = Panel("Exterior Constructions")
list_12 = Honeybee_ItemSelector(
    searchepconstruction_2,
    {"ASHRAE 90.1-2010 ATTICFLOOR CLIMATEZONE 2-7"}, selected="ASHRAE 90.1-2010 ATTICFLOOR CLIMATEZONE 2-7")
glass_name_2 = Panel("ExteriorGlaz1")
u_value_2 = Slider(2.84, range=0..15)
shgc_2 = Slider(0.3, range=0..1)
vlt_2 = Slider(0.5, range=0..1)
u_value_3 = Number(u_value)
shgc_3 = Number(shgc)
vlt_3 = Number(vlt)
u_value_4 = Number(glazing_u_value_3)
shgc_4 = Number(glazing_shgc)
vlt_4 = Number(glazing_vlt)

# ----
decomposeepconstruction = Honeybee_DecomposeEPConstruction(cnstrName=list_10)  # -> materials, comments, UValue_SI, UValue_IP, RValue_SI, RValue_IP; plug-in component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

epwindowmat = Honeybee_EnergyPlusWindowMaterial(name=glass_name_2, U_Value=u_value_4, SHGC=shgc_4, VT=vlt_4)  # -> EPMaterial; plug-in component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
toggle_8 = BooleanToggle(True)
addtoeplibrary_3 = Honeybee_AddToEnergyPlusLibrary(EPObject=epwindowmat, addToProjectLib=toggle_8, overwrite=toggle_8)  # -> readMe; plug-in component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
epconstruction = Honeybee_EnergyPlusConstruction(name=glass_name_2, layer_1=epwindowmat)  # -> EPConstruction; plug-in component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

decomposeepconstruction_2 = Honeybee_DecomposeEPConstruction(cnstrName=list_10)  # -> materials, comments, UValue_SI, UValue_IP, RValue_SI, RValue_IP; plug-in component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

epwindowmat_2 = Honeybee_EnergyPlusWindowMaterial(name=glass_name, U_Value=u_value_3, SHGC=shgc_3, VT=vlt_3)  # -> EPMaterial; plug-in component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
toggle_9 = BooleanToggle(True)
addtoeplibrary_4 = Honeybee_AddToEnergyPlusLibrary(EPObject=epwindowmat_2, addToProjectLib=toggle_9, overwrite=toggle_9)  # -> readMe; plug-in component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
epconstruction_2 = Honeybee_EnergyPlusConstruction(name=glass_name, layer_1=epwindowmat_2)  # -> EPConstruction; plug-in component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

item_45 = ListItem(List=decomposeepconstruction.materials, Index=0, Wrap=True)  # -> Item, Item1, Item2
item_46 = ListItem(List=decomposeepconstruction_2.materials, Index=0, Wrap=True)  # -> Item, Item1, Item2
epconstruction_3 = Honeybee_EnergyPlusConstruction(name="wall", layer_1=item_45.Item, layer_2=epnomassmat, layer_3=item_45.Item2)  # -> EPConstruction; plug-in component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
epconstruction_4 = Honeybee_EnergyPlusConstruction(name="roof", layer_1=item_46.Item, layer_2=epnomassmat_2, layer_3=item_46.Item2)  # -> EPConstruction; plug-in component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
setepzonecnstr = Honeybee_SetEPZoneConstruction(
    HBZones=hb_zones,
    wallEPConstruction=epconstruction_3,
    windowEPConstruction=epconstruction,
    roofEPConstruction=epconstruction_4,
    floorEPConstruction=list_12)  # -> simplify(modifiedHBZones); plug-in component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
setepzoneintcnstr = Honeybee_SetEPZoneInteriorConstruction(
    HBZones=setepzonecnstr,
    intWallEPConstruction=list_8,
    intWindowEPConstruction=epconstruction_2,
    intFloorEPConstruction=list_9,
    intCeilingEPConstruction=list_7)  # -> simplify(modifiedHBZones); plug-in component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
solveadjc = Honeybee_SolveAdjacencies(HBZones=flatten(setepzoneintcnstr), findAdjc=run)  # -> readMe, HBZonesWADJ; plug-in component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
split_3 = TextSplit(Text=epconstruction_4, Separators=" ")
item_47 = ListItem(List=split_3, Index=0, Wrap=True)  # -> Item, Item1, Item2
perimetercore = Honeybee_PerimeterCoreZoning(HBZones=flatten(solveadjc.HBZonesWADJ))  # -> perimeters, interiors; plug-in component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
decomposeepconstruction_3 = Honeybee_DecomposeEPConstruction(cnstrName=item_47.Item)  # -> materials, comments, UValue_SI, UValue_IP, RValue_SI, RValue_IP; plug-in component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

# ----
# Set Internal Loads
hb_zones_2 = Brep(flatten(perimetercore.perimeters))

# ----
# Set Internal Loads
hb_zones_3 = Brep(flatten(perimetercore.interiors))

multiplication_7 = Multiplication(A=infiltration_2, B=0.005078)
multiplication_8 = Multiplication(A=equipment_load_w_ft2, B=10.76391)
multiplication_9 = Multiplication(A=internal_load_perimeter, B=10.76391)
multiplication_10 = Multiplication(A=oa_perimeter_2, B=0.005078)
division_8 = Division(A=ft2_per_person, B=10.76391)
division_9 = Division(A=cfm_person, B=2119)
division_10 = Division(A=1, B=division_8)
infil_per_sf_of_facade = Number(multiplication_7)
panel_63 = Panel("convert to metric")

ach2m3_s_m2_calculator = Honeybee_infORventPerAreaCalculator(HBZones=flatten(hb_zones_2), airFlowRate=infil_per_sf_of_facade, ACHorM3sM2=Toggle(True))  # -> readMe, infORventPerArea, allFloors; plug-in component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

setepzoneloads = Honeybee_SetEnergyPlusZoneLoads(
    HBZones=hb_zones_2,
    equipmentLoadPerArea=multiplication_8,
    infiltrationRatePerArea=ach2m3_s_m2_calculator.infORventPerArea,
    lightingDensityPerArea=multiplication_9,
    numOfPeoplePerArea=division_10,
    ventilationPerArea=multiplication_10,
    ventilationPerPerson=division_9)  # -> loads, HBZones; plug-in component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

# ----
# convert metric to imperial
item_48 = ListItem(List=setepzoneloads.HBZones, Index=0, Wrap=True)
gethbzoneeploads = Honeybee_GetZoneEnergyPlusLoads(HBZone=item_48)  # -> equipmentLoadPerArea, infiltrationRatePerArea, lightingDensityPerArea, numOfPeoplePerArea, ventilationPerArea, ventilationPerPerson; plug-in component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
division_11 = Division(A=1, B=gethbzoneeploads.numOfPeoplePerArea)
division_12 = Division(A=gethbzoneeploads.equipmentLoadPerArea, B=10.76391)
division_13 = Division(A=gethbzoneeploads.lightingDensityPerArea, B=10.76391)
division_14 = Division(A=gethbzoneeploads.ventilationPerArea, B=0.005078)
multiplication_11 = Multiplication(A=gethbzoneeploads.ventilationPerPerson, B=2119)
multiplication_12 = Multiplication(A=division_11, B=10.76391)
concat_6 = Concatenate(FragmentA="Equipment Load (W/sf)", FragmentB=division_12, JoinSeparator=": ")
concat_7 = Concatenate(FragmentA="Infiltration Rate (m3/s-m2)", FragmentB=gethbzoneeploads.infiltrationRatePerArea, JoinSeparator=": ")
concat_8 = Concatenate(FragmentA="Lighting Power Density (W/sf)", FragmentB=division_13, JoinSeparator=": ")
concat_9 = Concatenate(FragmentA="People Per Area (sf/per)", FragmentB=multiplication_12, JoinSeparator=": ")
concat_10 = Concatenate(FragmentA="Ventilation Per Area (CFM/sf)", FragmentB=division_14, JoinSeparator=": ")
concat_11 = Concatenate(FragmentA="Ventilation Per Person (CFM/person)", FragmentB=multiplication_11, JoinSeparator=": ")
merge_7 = Merge(Data1=concat_6, Data2=concat_7, Data3=concat_8, Data4=concat_9, Data5=concat_10, Data6=concat_11)

default_schedules = Panel(merge_7)

multiplication_13 = Multiplication(A=infiltration_2, B=0.005078)
multiplication_14 = Multiplication(A=equipment_load_w_ft2_2, B=10.76391)
multiplication_15 = Multiplication(A=internal_load_core, B=10.76391)
multiplication_16 = Multiplication(A=oa_core, B=0.005078)
division_15 = Division(A=ft2_per_person_2, B=10.76391)
division_16 = Division(A=cfm_person_2, B=2119)
division_17 = Division(A=1, B=division_15)
infil_per_sf_of_facade_2 = Number(multiplication_13)

ach2m3_s_m2_calculator_2 = Honeybee_infORventPerAreaCalculator(HBZones=flatten(hb_zones_3), airFlowRate=infil_per_sf_of_facade_2, ACHorM3sM2=Toggle(True))  # -> readMe, infORventPerArea, allFloors; plug-in component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

setepzoneloads_2 = Honeybee_SetEnergyPlusZoneLoads(
    HBZones=hb_zones_3,
    equipmentLoadPerArea=multiplication_14,
    infiltrationRatePerArea=ach2m3_s_m2_calculator_2.infORventPerArea,
    lightingDensityPerArea=multiplication_15,
    numOfPeoplePerArea=division_17,
    ventilationPerArea=multiplication_16,
    ventilationPerPerson=division_16)  # -> loads, HBZones; plug-in component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

# ----
# convert metric to imperial
item_49 = ListItem(List=setepzoneloads_2.HBZones, Index=0, Wrap=True)
gethbzoneeploads_2 = Honeybee_GetZoneEnergyPlusLoads(HBZone=item_49)  # -> equipmentLoadPerArea, infiltrationRatePerArea, lightingDensityPerArea, numOfPeoplePerArea, ventilationPerArea, ventilationPerPerson; plug-in component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
division_18 = Division(A=1, B=gethbzoneeploads_2.numOfPeoplePerArea)
division_19 = Division(A=gethbzoneeploads_2.equipmentLoadPerArea, B=10.76391)
division_20 = Division(A=gethbzoneeploads_2.lightingDensityPerArea, B=10.76391)
division_21 = Division(A=gethbzoneeploads_2.ventilationPerArea, B=0.005078)
multiplication_17 = Multiplication(A=gethbzoneeploads_2.ventilationPerPerson, B=2119)
multiplication_18 = Multiplication(A=division_18, B=10.76391)
concat_12 = Concatenate(FragmentA="Equipment Load (W/sf)", FragmentB=division_19, JoinSeparator=": ")
concat_13 = Concatenate(FragmentA="Infiltration Rate (m3/s-m2)", FragmentB=gethbzoneeploads_2.infiltrationRatePerArea, JoinSeparator=": ")
concat_14 = Concatenate(FragmentA="Lighting Power Density (W/sf)", FragmentB=division_20, JoinSeparator=": ")
concat_15 = Concatenate(FragmentA="People Per Area (sf/per)", FragmentB=multiplication_18, JoinSeparator=": ")
concat_16 = Concatenate(FragmentA="Ventilation Per Area (CFM/sf)", FragmentB=division_21, JoinSeparator=": ")
concat_17 = Concatenate(FragmentA="Ventilation Per Person (CFM/person)", FragmentB=multiplication_17, JoinSeparator=": ")
merge_8 = Merge(Data1=concat_12, Data2=concat_13, Data3=concat_14, Data4=concat_15, Data5=concat_16, Data6=concat_17)

default_schedules_2 = Panel(merge_8)

# ----
# Set Schedules
zone_program_3 = Text(type_1)
hb_zones_4 = Brep(flatten([setepzoneloads.HBZones, setepzoneloads_2.HBZones]))

getepschedules = Honeybee_GetEnergyPlusSchedules(zoneProgram=zone_program_3)  # -> occupancySchedule, occupancyActivitySch, heatingSetPtSchedule, coolingSetPtSchedule, lightingSchedule, equipmentSchedule, infiltrationSchedule; plug-in component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
default_schedules_3 = Panel([getepschedules.occupancySchedule, getepschedules.occupancyActivitySch, getepschedules.heatingSetPtSchedule, getepschedules.coolingSetPtSchedule, getepschedules.lightingSchedule, getepschedules.equipmentSchedule, getepschedules.infiltrationSchedule])

setepzoneschedules = Honeybee_SetEnergyPlusZoneSchedules(HBZones=hb_zones_4, occupancyActivitySchs=getepschedules.occupancyActivitySch)  # -> schedules, simplify(HBZones); plug-in component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
setepzonethresholds = Honeybee_SetEnergyPlusZoneThresholds(
    HBZones=setepzoneschedules.HBZones,
    coolingSetPt=f2c,
    coolingSetback=f2c_3,
    heatingSetPt=f2c_4,
    heatingSetback=f2c_2,
    daylightIllumSetPt=300)  # -> readMe, HBZones; plug-in component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

# ----
# Visualize Schedules
number_slider_10 = Slider(3, range=0..10)  # disabled
zones = Brep()  # disabled
item_50 = ListItem(List=zones, Index=0, Wrap=True)  # disabled
setepzoneschedules_2 = Honeybee_SetEnergyPlusZoneSchedules(HBZones=item_50)  # -> schedules, simplify(HBZones); disabled; plug-in component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
panel_65 = Panel(setepzoneschedules_2.schedules)  # disabled
panel_66 = Panel("0")  # disabled
panel_67 = Panel("0.25")  # disabled
_3dchart = Ladybug_3DChart(basePoint=pt_5, xScale=panel_67, zScale=panel_66)  # -> readMe, graphMesh, graphCurves, legend, legendBasePts, title, titleBasePts, dataPts, conditionalHOY; disabled; plug-in component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
swatch_37 = ColourSwatch(SwatchColor=RGB(0, 0, 0))  # disabled
preview = CustomPreview(Geometry=_3dchart.graphCurves, Shader=swatch_37)  # disabled

panel_68 = Panel(":")  # disabled
panel_69 = Panel("Isolate schedule")  # disabled
panel_70 = Panel("")  # disabled
split_4 = TextSplit(Text=setepzoneschedules_2.schedules, Separators=panel_70)  # disabled
item_51 = ListItem(List=split_4, Index=number_slider_10, Wrap=True)  # disabled
split_5 = TextSplit(Text=item_51, Separators=panel_68)  # disabled
item_52 = ListItem(List=split_5, Index=0, Wrap=True)  # -> Item, Item1; disabled
trim = TextTrim(Text=item_52.Item1, Start=True, End=True)  # disabled

panel_71 = Panel(item_52.Item1)  # disabled
convertepschvalues = Honeybee_ConvertEnergyPlusScheduleToValues(schName=trim)  # -> values; disabled; plug-in component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

panel_72 = Panel(trim)  # disabled
_3dchart_2 = Ladybug_3DChart(basePoint=pt_5, xScale=panel_67, zScale=panel_66)  # -> readMe, graphMesh, graphCurves, legend, legendBasePts, title, titleBasePts, dataPts, conditionalHOY; disabled; plug-in component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
preview_2 = CustomPreview(Geometry=_3dchart_2.graphCurves, Shader=swatch_37)  # disabled

# ----
# Compile Final Model
add_hb_zones_here = Merge(Data1=setepzonethresholds.HBZones)

run_3 = Boolean(bool_2)
n_window_wall_ratio_2 = Number(num_4)
e_window_wall_ratio_2 = Number(num)
hbzoneswadj = Brep(add_hb_zones_here)
s_window_wall_ratio_2 = Number(num_2)
w_window_wall_ratio_2 = Number(num_3)

panel_73 = Panel("Add Glazing")
glzparamlist = Honeybee_GlazingParametersList(
    northGlzParam=n_window_wall_ratio_2,
    westGlzParam=w_window_wall_ratio_2,
    southGlzParam=s_window_wall_ratio_2,
    eastGlzParam=e_window_wall_ratio_2)  # -> glzParamList; plug-in component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
glazingcreator = Honeybee_GlazingBasedOnRatio(
    HBObjects=hbzoneswadj,
    glzRatio=glzparamlist,
    breakUpWindow=Toggle(False),
    windowHeight=window_height_2,
    sillHeight=sill_height_2,
    runIt=run_3)  # -> readMe, HBObjWGLZ; plug-in component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

hb_zones_5 = Brep(flatten(glazingcreator.HBObjWGLZ))

epwindowshades = Honeybee_EnergyPlusWindowShadeGenerator(HBObjects=flatten(hb_zones_5), shadeMaterial=epshademat, depth=shading_depth, numOfShds=1, runIt=toggle_3)  # -> readMe, port, HBObjWShades, port_2, windowBreps, shadeBreps, port_3, shadeMatName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; disabled; plug-in component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
brep = Brep(epwindowshades.shadeBreps)  # disabled
hb_epcontextsrf = HoneybeeEPContextSurfaces(shdSurfaces=flatten(brep))  # -> HBContext; inputs shdSurfaces: list of Brep, justBoundingBox: Boolean; disabled
# ---------- hb_epcontextsrf: Python ----------
"""
prepare shading/context geometries

    Args:
        northVectorOrRotation: A vector that shows North or a number that shows
                               the rotation of the North from the Y axis
        bldgMasses: List of closed Breps as thermal zones.
    Returns:
        report: ...
        thermalZones: Thermal zone's geometries for visualiza
"""

ghenv.Component.Name = 'Honeybee EP context Surfaces'
ghenv.Component.NickName = 'HB_EPContextSrf'
ghenv.Component.Message = 'VER 0.0.60\nNOV_04_2016'
ghenv.Component.IconDisplayMode = ghenv.Component.IconDisplayMode.application
ghenv.Component.Category = "Honeybee"
ghenv.Component.SubCategory = "10 | Energy | Energy"
#compatibleHBVersion = VER 0.0.57\nNOV_04_2016
#compatibleLBVersion = VER 0.0.59\nFEB_01_2015
ghenv.Component.AdditionalHelpFromDocStrings = "2"

import rhinoscriptsyntax as rs
import Rhino as rc
import scriptcontext as sc
import os
import System
import Grasshopper.Kernel as gh
import uuid

tolerance = sc.doc.ModelAbsoluteTolerance
import math


def main(shdSurfaces, EPTransSchedule, meshingSettings, justBoundingBox):
    
    # import the classes
    if sc.sticky.has_key('honeybee_release'):

        try:
            if not sc.sticky['honeybee_release'].isCompatible(ghenv.Component): return -1
            if sc.sticky['honeybee_release'].isInputMissing(ghenv.Component): return -1
        except:
            warning = "You need a newer version of Honeybee to use this compoent." + \
            " Use updateHoneybee component to update userObjects.\n" + \
            "If you have already updated userObjects drag Honeybee_Honeybee component " + \
            "into canvas and try again."
            w = gh.GH_RuntimeMessageLevel.Warning
            ghenv.Component.AddRuntimeMessage(w, warning)
            return -1
        
        # don't customize this part
        hb_EPSrf = sc.sticky["honeybee_EPSurface"]
        hb_EPSHDSurface = sc.sticky["honeybee_EPShdSurface"]
        hb_RADMaterialAUX = sc.sticky["honeybee_RADMaterialAUX"]
        hb_EPObjectsAux = sc.sticky["honeybee_EPObjectsAUX"]()
        HBScheduleList = sc.sticky["honeybee_ScheduleLib"].keys()

        ########################################################################
        #----------------------------------------------------------------------#
        shdBreps = []
        # create bounding box of shading geometries
        if justBoundingBox:
            for brep in shdSurfaces:
                if brep.Faces.Count>1 or not brep.Faces[0].IsPlanar(sc.doc.ModelAbsoluteTolerance):
                    shdBreps.append(brep.GetBoundingBox(True).ToBrep())
                else:
                    shdBreps.append(brep)
        else:
            shdBreps = shdSurfaces
        
        shadingClasses = []
        shadingMeshPreview = []
        
        if meshingSettings == None:
            mp = rc.Geometry.MeshingParameters.Minimal
            mp.SimplePlanes = True
        else:
            mp = meshingSettings
        
        def getRadMaterialName(radMaterial):
            nameStr = radMaterial.split(" ")[2]
            name =  nameStr.split("\n")[0]
            return name
        
        for brepCount, brep in enumerate(shdBreps):
            if brep != None:
                isPlanar = True
                # check planarity
                for face in brep.Faces:
                    if not face.IsPlanar(tolerance):
                        isPlanar = False
                        break
                
                shadingBreps = []
                if not isPlanar:
                    meshArray = rc.Geometry.Mesh.CreateFromBrep(brep, mp)
                    for mesh in meshArray:
                        for meshFace in range(mesh.Faces.Count):
                            vertices = list(mesh.Faces.GetFaceVertices(meshFace))[1:]
                            vertices = vertices + [sc.doc.ModelAbsoluteTolerance]
                            # create the brep from mesh
                            shdBrep = rc.Geometry.Brep.CreateFromCornerPoints(*vertices)
                            shadingBreps.append(shdBrep)
                else:
                    for face in brep.Faces:
                        shadingBreps.append(face.DuplicateFace(False))
                
                for faceCount, shdBrep in enumerate(shadingBreps):
                        thisShading = hb_EPSHDSurface(shdBrep, 1000*brepCount + faceCount, 'shdSrf_' + `brepCount` + '_' + `faceCount` + "_" + str(uuid.uuid4()))
                        
                        # add transmittance schedule if any
                        if EPTransSchedule!=None:
                            schedule= EPTransSchedule.upper()
                            if schedule!=None and not schedule.lower().endswith(".csv") and schedule not in HBScheduleList:
                                msg = "Cannot find " + schedule + " in Honeybee schedule library."
                                print msg
                                ghenv.Component.AddRuntimeMessage(gh.GH_RuntimeMessageLevel.Warning, msg)
                                return -1
                            elif schedule!=None and schedule.lower().endswith(".csv"):
                                # check if csv file is existed
                                if not os.path.isfile(schedule):
                                    msg = "Cannot find the shchedule file: " + schedule
                                    print msg
                                    ghenv.Component.AddRuntimeMessage(gh.GH_RuntimeMessageLevel.Warning, msg)
                                    return -1
                            
                            thisShading.TransmittanceSCH = schedule
                        
                        # add the Rad Material if any
                        if RADMaterial!=None:
                            # if it is just the name of the material make sure it is already defined
                            if len(RADMaterial.split(" ")) == 1:
                                # if the material is not in the library add it to the library
                                if not hb_RADMaterialAUX.isMatrialExistInLibrary(RADMaterial):
                                    warningMsg = "Can't find " + RADMaterial + " in RAD Material Library.\n" + \
                                                "Add the material to the library and try again."
                                    ghenv.Component.AddRuntimeMessage(gh.GH_RuntimeMessageLevel.Warning, warningMsg)
                                    return
                                
                                try:
                                    thisShading.setRADMaterial(RADMaterial)
                                except Exception, e:
                                    print e
                                    warningMsg = "You are using an old version of Honeybee_Honeybee! Update your files and try again."
                                    print warningMsg
                                    ghenv.Component.AddRuntimeMessage(gh.GH_RuntimeMessageLevel.Warning, warningMsg)
                                    return
                                
                                addedToLib = True
                            else:
                                
                                # try to add the material to the library
                                addedToLib, thisShading.RadMaterial = hb_RADMaterialAUX.analyseRadMaterials(RADMaterial, True)
                                
                            if addedToLib==False:
                                warningMsg = "Failed to add " + RADMaterial + " to the Library."
                                ghenv.Component.AddRuntimeMessage(gh.GH_RuntimeMessageLevel.Warning, warningMsg)
                                return
                        
                        # add shading to the list
                        shadingClasses.append(thisShading)
                
        # add to the hive
        hb_hive = sc.sticky["honeybee_Hive"]()
        HBContext  = hb_hive.addToHoneybeeHive(shadingClasses, ghenv.Component)
        return HBContext
        ################################################################################################
    else:
        print "You should first let Honeybee to fly..."
        w = gh.GH_RuntimeMessageLevel.Warning
        ghenv.Component.AddRuntimeMessage(w, "You should first let Honeybee to fly...")
        return -1
        

if _shdSurfaces and _shdSurfaces[0]!=None:
    # add cleaning function
    result= main(_shdSurfaces, EPTransSchedule_, meshingSettings_, justBoundingBox_)
    
    if result != -1: HBContext = result
# ---------- end hb_epcontextsrf ----------

# ----
# Visualize the Zones
hb_zones_6 = Brep(hb_zones_5)  # disabled

decomposebytype = Honeybee_DecomposeBasedOnType(HBZone=hb_zones_6)  # -> simplify(walls), interiorWalls, airWalls, windows, interiorWindows, skylights, roofs, ceilings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; disabled; plug-in component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
swatch_38 = ColourSwatch(SwatchColor=RGB(128, 128, 128))  # disabled
swatch_39 = ColourSwatch(SwatchColor=RGBA(178, 232, 255, 108))  # disabled
swatch_40 = ColourSwatch(SwatchColor=RGB(232, 230, 162))  # disabled
swatch_41 = ColourSwatch(SwatchColor=RGB(214, 131, 131))  # disabled
preview_3 = CustomPreview(Geometry=decomposebytype.interiorWalls, Shader=swatch_40)  # disabled
preview_4 = CustomPreview(Geometry=decomposebytype.windows, Shader=swatch_39)  # disabled
preview_5 = CustomPreview(Geometry=decomposebytype.walls, Shader=swatch_41)  # disabled
preview_6 = CustomPreview(Geometry=decomposebytype.ceilings, Shader=swatch_38)  # disabled

preview_7 = CustomPreview(Geometry=decomposebytype.roofs, Shader=swatch_28)  # disabled
final_hb_zones = Brep(flatten(hb_zones_5))
filter = StreamFilter(Gate=set_mech_systems_2, Stream1=final_hb_zones)
hvacsystem = Honeybee_AssignHVACSystem(HBZones=flatten(filter), HVACSystems=system_type)  # -> readMe, HBZones; plug-in component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
hb_zones_7 = Brep(flatten(hvacsystem.HBZones))

final_hb_zones_2 = Brep(hb_zones_7)

exporttoopenstudio_2 = Honeybee_ExportToOpenStudio(
    epwWeatherFile=epw_stat.epwFile,
    analysisPeriod=analysisperiod.analysisPeriod,
    energySimPar=energysimpar,
    HBZones=flatten(final_hb_zones_2),
    simulationOutputs=flatten(epoutput.simulationOutputs),
    writeOSM=run_eplus_4,
    runSimulation=Slider(3, range=0..10),
    fileName=concat,
    workingDir="D:\Dropbox\000_AEC_Hackathon2016\Runs")  # -> readMe, osmFileAddress, idfFileAddress, resultsFileAddress, eioFileAddress, rddFileAddress, studyFolder; plug-in component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
result_address = FilePath(exporttoopenstudio_2.resultsFileAddress)  # disabled

# ----
# Review Data - Mech System
# Normalize Results by Floor Area
readepresult = Honeybee_ReadEPResult(resultFileAddress=result_address)  # -> port, port_2, cooling, heating, electricLight, electricEquip, fanElectric, pumpElectric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; disabled; plug-in component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
final_hb_zones_3 = Brep(hb_zones_7)  # disabled
flrnorm = Honeybee_NormalizeDataByFloorArea(simData=readepresult.cooling, HBZones=flatten(final_hb_zones_3))  # -> totNormData, zoneNormData; disabled; plug-in component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
flrnorm_2 = Honeybee_NormalizeDataByFloorArea(simData=readepresult.heating, HBZones=flatten(final_hb_zones_3))  # -> totNormData, zoneNormData; disabled; plug-in component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
flrnorm_3 = Honeybee_NormalizeDataByFloorArea(simData=readepresult.electricLight, HBZones=flatten(final_hb_zones_3))  # -> totNormData, zoneNormData; disabled; plug-in component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
flrnorm_4 = Honeybee_NormalizeDataByFloorArea(simData=readepresult.electricEquip, HBZones=flatten(final_hb_zones_3))  # -> totNormData, zoneNormData; disabled; plug-in component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
flrnorm_5 = Honeybee_NormalizeDataByFloorArea(simData=readepresult.fanElectric, HBZones=flatten(final_hb_zones_3))  # -> totNormData, zoneNormData; disabled; plug-in component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
flrnorm_6 = Honeybee_NormalizeDataByFloorArea(simData=readepresult.pumpElectric, HBZones=flatten(final_hb_zones_3))  # -> totNormData, zoneNormData; disabled; plug-in component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
wh2btu = Ladybug_Wh2BTU(Wh=[flrnorm.totNormData, flrnorm_2.totNormData, flrnorm_3.totNormData, flrnorm_4.totNormData, flrnorm_5.totNormData, flrnorm_6.totNormData])  # -> BTU; disabled; plug-in component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
strnum_2 = Ladybug_SeparateData(inputList=flatten(wh2btu))  # -> numbers, strings; disabled; plug-in component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
strnum_3 = Ladybug_SeparateData(inputList=flatten([flrnorm.totNormData, flrnorm_2.totNormData, flrnorm_3.totNormData, flrnorm_4.totNormData, flrnorm_5.totNormData, flrnorm_6.totNormData]))  # -> numbers, strings; disabled; plug-in component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

lng_3 = ListLength(List=final_hb_zones_3)  # disabled
subtraction_4 = Subtraction(A=lng_3, B=lng)  # disabled
series_4 = Series(Start=lng, Step=1, Count=subtraction_4)  # disabled
int_8 = Integer(graft(series_4))  # disabled
path_2 = ConstructPath(Indices=int_8)  # -> simplify(Branch); disabled
readepsrfresult = Honeybee_ReadEPSurfaceResult(resultFileAddress=result_address)  # -> port, port_2, surfaceEnergyFlow, opaqueEnergyFlow, glazEnergyFlow, windowTotalSolarEnergy, windowBeamEnergy, windowDiffEnergy, port_3, port_4; disabled; plug-in component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
area_4 = Area(Geometry=final_hb_zones_3)  # -> Area, Centroid; disabled
flrnorm_7 = Honeybee_NormalizeDataByFloorArea(simData=readepresult.port_2, HBZones=flatten(final_hb_zones_3))  # -> totNormData, zoneNormData; disabled; plug-in component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
selectandaveragedata = Ladybug_AverageData(annualHourlyData=flrnorm_7.totNormData, totalOrAverage=False)  # -> readMe, selHourlyData, averagedDaily, averagedMonthly, avrMonthlyPerHour, avrAnalysisPeriod; disabled; plug-in component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
strnum_4 = Ladybug_SeparateData(inputList=flatten(flrnorm_7.totNormData))  # -> numbers, strings; disabled; plug-in component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
_3dchart_3 = Ladybug_3DChart(inputData=flatten(flrnorm_7.totNormData), basePoint=pt_2, xScale=panel_26, zScale=panel_25, legendPar=legendpar)  # -> readMe, graphMesh, graphCurves, legend, legendBasePts, title, titleBasePts, dataPts, conditionalHOY; disabled; plug-in component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
barchart = Ladybug_MonthlyBarChart(inputData=flatten(selectandaveragedata.averagedMonthly), plotFromZero=toggle, basePoint=pt_2)  # -> readMe, dataMesh, dataCurves, dataCrvColors, graphAxes, graphLabels, title, titleBasePt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; disabled; plug-in component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
equals = Equality(FirstNumber=strnum_4.numbers, SecondNumber=0)  # -> Equality, Inequality; disabled
ma_3 = MassAddition(Input=equals.Equality)  # -> Result, PartialResults; disabled
division_22 = Division(A=ma_3.Result, B=8760)  # disabled
item_53 = ListItem(List=final_hb_zones_3, Index=number_slider_4, Wrap=True)  # disabled
area_5 = Area(Geometry=item_53)  # -> Area, Centroid; disabled
panel_74 = Panel(exporttoopenstudio_2.idfFileAddress)
split_6 = SplitTree(Data=readepresult.electricEquip, Masks=flatten(path_2))  # -> Positive, Negative; disabled
energybalance = Honeybee_ConstructEnergyBalance(
    HBZones=flatten(final_hb_zones_3),
    cooling=readepresult.cooling,
    heating=readepresult.heating,
    electricLight=readepresult.electricLight,
    electricEquip=readepresult.electricEquip,
    peopleGains=readepresult.peopleGains,
    totalSolarGain=readepresult.totalSolarGain,
    infiltrationEnergy=readepresult.infiltrationEnergy,
    mechVentilationEnergy=readepresult.port_3,
    surfaceEnergyFlow=readepsrfresult.surfaceEnergyFlow)  # -> readMe, port, flrNormEnergyBal, flrNormBalWStorage, port_2, modelEnergyBalance, energyBalWithStorage; disabled; plug-in component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
debrep_2 = DeconstructBrep(Brep=final_hb_zones_3)  # -> Faces, Edges, Vertices; disabled
strnum_5 = Ladybug_SeparateData(inputList=flatten(readepresult.pumpElectric))  # -> numbers, strings; disabled; plug-in component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
strnum_6 = Ladybug_SeparateData(inputList=flatten(readepresult.cooling))  # -> numbers, strings; disabled; plug-in component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
strnum_7 = Ladybug_SeparateData(inputList=flatten(readepresult.heating))  # -> numbers, strings; disabled; plug-in component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
strnum_8 = Ladybug_SeparateData(inputList=flatten(readepresult.electricLight))  # -> numbers, strings; disabled; plug-in component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
strnum_9 = Ladybug_SeparateData(inputList=flatten(readepresult.electricEquip))  # -> numbers, strings; disabled; plug-in component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
strnum_10 = Ladybug_SeparateData(inputList=flatten(readepresult.fanElectric))  # -> numbers, strings; disabled; plug-in component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
item_54 = ListItem(List=debrep_2.Faces, Index=0, Wrap=True)  # disabled
panel_75 = Panel(exporttoopenstudio_2.readMe)
flrnorm_8 = Honeybee_NormalizeDataByFloorArea(HBZones=flatten(final_hb_zones_3))  # -> totNormData, zoneNormData; disabled; plug-in component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
flrnorm_9 = Honeybee_NormalizeDataByFloorArea(simData=readepresult.totalSolarGain, HBZones=flatten(final_hb_zones_3))  # -> totNormData, zoneNormData; disabled; plug-in component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
flrnorm_10 = Honeybee_NormalizeDataByFloorArea(simData=readepresult.peopleGains, HBZones=flatten(final_hb_zones_3))  # -> totNormData, zoneNormData; disabled; plug-in component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
area_6 = Area(Geometry=item_54)  # -> Area, Centroid; disabled
wh2btu_2 = Ladybug_Wh2BTU(Wh=strnum_5.numbers)  # -> BTU; disabled; plug-in component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
flip = FlipMatrix(Data=wh2btu_2)  # disabled
ma_4 = MassAddition(Input=flip)  # -> Result, PartialResults; disabled
flip_2 = FlipMatrix(Data=ma_4.Result)  # disabled
merge_9 = Merge(Data2=flatten(flip_2))  # disabled
wh2btu_3 = Ladybug_Wh2BTU(Wh=strnum_6.numbers)  # -> BTU; disabled; plug-in component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
merge_10 = Merge(Data1=flatten(strnum_6.strings), Data2=flatten(wh2btu_3))  # disabled
lng_4 = ListLength(List=merge_10)  # disabled
wh2btu_4 = Ladybug_Wh2BTU(Wh=strnum_7.numbers)  # -> BTU; disabled; plug-in component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
merge_11 = Merge(Data1=flatten(strnum_7.strings), Data2=flatten(wh2btu_4))  # disabled
wh2btu_5 = Ladybug_Wh2BTU(Wh=strnum_8.numbers)  # -> BTU; disabled; plug-in component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
flip_3 = FlipMatrix(Data=wh2btu_5)  # disabled
ma_5 = MassAddition(Input=flip_3)  # -> Result, PartialResults; disabled
flip_4 = FlipMatrix(Data=ma_5.Result)  # disabled
merge_12 = Merge(Data2=flatten(flip_4))  # disabled
wh2btu_6 = Ladybug_Wh2BTU(Wh=strnum_9.numbers)  # -> BTU; disabled; plug-in component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
flip_5 = FlipMatrix(Data=wh2btu_6)  # disabled
ma_6 = MassAddition(Input=flip_5)  # -> Result, PartialResults; disabled
flip_6 = FlipMatrix(Data=ma_6.Result)  # disabled
merge_13 = Merge(Data2=flatten(flip_6))  # disabled
ma_7 = MassAddition(Input=wh2btu_6)  # -> Result, PartialResults; disabled
wh2btu_7 = Ladybug_Wh2BTU(Wh=strnum_10.numbers)  # -> BTU; disabled; plug-in component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
merge_14 = Merge(Data1=flatten(strnum_10.strings), Data2=flatten(wh2btu_7))  # disabled
merge_15 = Merge(Data1=merge_10, Data2=merge_11, Data3=merge_12, Data4=merge_13, Data5=merge_14, Data6=merge_9)  # disabled
partition = PartitionList(List=merge_15, Size=lng_4)  # disabled
panel_76 = Panel(ma_7.Result)  # disabled
panel_77 = Panel(exporttoopenstudio_2.osmFileAddress)
ma_8 = MassAddition(Input=flatten(area_6.Area))  # -> Result, PartialResults; disabled
hourly_data = Data(partition)  # disabled
ma_9 = MassAddition(Input=flatten(wh2btu_2))  # -> Result, PartialResults; disabled
ma_10 = MassAddition(Input=flatten(wh2btu_3))  # -> Result, PartialResults; disabled
ma_11 = MassAddition(Input=flatten(wh2btu_4))  # -> Result, PartialResults; disabled
ma_12 = MassAddition(Input=flatten(wh2btu_5))  # -> Result, PartialResults; disabled
ma_13 = MassAddition(Input=flatten(wh2btu_6))  # -> Result, PartialResults; disabled
ma_14 = MassAddition(Input=flatten(wh2btu_7))  # -> Result, PartialResults; disabled
subtraction_5 = Subtraction(A=ma_8.Result, B=ma_2.Result)  # disabled
merge_16 = Merge(Data1=ma_10.Result, Data2=ma_11.Result, Data3=ma_12.Result, Data4=ma_13.Result, Data5=ma_14.Result, Data6=ma_9.Result)  # disabled
division_23 = Division(A=ma_8.Result, B=subtraction_5)  # disabled
true_area_m2 = Number(subtraction_5)  # disabled
selectandaveragedata_2 = Ladybug_AverageData(annualHourlyData=simplify(hourly_data), totalOrAverage=toggle_2)  # -> readMe, selHourlyData, totaledDaily, totaledMonthly, totMonthlyPerHour, totAnalysisPeriod; disabled; plug-in component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
strnum_11 = Ladybug_SeparateData(inputList=flatten(selectandaveragedata_2.totaledMonthly))  # -> numbers, strings; disabled; plug-in component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
total_area_m2 = Number(ma_8.Result)  # disabled
normalized_dataplenum_bug_fix_factor = Number(division_23)  # disabled
item_55 = ListItem(List=merge_16, Index=0, Wrap=True)  # -> Item, Item1, Item2, Item3, Item4, Item5; disabled
multiplication_19 = Multiplication(A=strnum_11.numbers, B=180000)  # disabled
kbtu = Panel(merge_16)  # disabled
multiplication_20 = Multiplication(A=true_area_m2, B=10.7639)  # disabled
multiplication_21 = Multiplication(A=total_area_m2, B=10.76)  # disabled
division_24 = Division(A=multiplication_19, B=10.76)  # disabled
merge_17 = Merge(Data1=strnum_11.strings, Data2=division_24)  # disabled
true_area_ft2 = Number(multiplication_20)  # disabled
merge_18 = Merge(
    Data1=item_55.Item,
    Data2=item_55.Item1,
    Data3=item_55.Item2,
    Data4=item_55.Item3,
    Data5=item_55.Item4,
    Data6=item_55.Item5,
    Data7=panel_34)  # disabled
ma_15 = MassAddition(Input=flatten(merge_18))  # -> Result, PartialResults; disabled
division_25 = Division(A=ma_15.Result, B=multiplication_21)  # disabled
selectandaveragedata_3 = Ladybug_AverageData(annualHourlyData=energybalance.modelEnergyBalance, totalOrAverage=toggle_2)  # -> readMe, selHourlyData, totaledDaily, totaledMonthly, totMonthlyPerHour, totAnalysisPeriod; disabled; plug-in component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
eui_ip_kbtu_ft2 = Panel(division_25)  # disabled

data = Data(simplify(selectandaveragedata_2.totaledMonthly))  # disabled
barchart_2 = Ladybug_MonthlyBarChart(inputData=flatten(data), stackValues=toggle_6, altYAxisTitle=panel_44, yScale=panel_45, legendPar=legendpar_2)  # -> readMe, dataMesh, dataCurves, dataCrvColors, graphAxes, graphLabels, title, titleBasePt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; disabled; plug-in component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
item_56 = ListItem(List=barchart_2.legend, Index=0, Wrap=True)  # disabled
medges = MeshEdges(Mesh=[barchart_2.dataMesh, item_56])  # -> NakedEdges, InteriorEdges, NonManifoldEdges; disabled
preview_8 = CustomPreview(Geometry=[barchart_2.graphAxes, medges.NakedEdges, medges.InteriorEdges], Shader=swatch_35)  # disabled

bang_2 = ExplodeTree(Data=strnum_3.numbers)  # -> Branch0, Branch1, Branch2, Branch3, Branch4, Branch5; disabled
multiplication_22 = Multiplication(A=bang_2.Branch1, B=cost_of_heating_fuel_kwh)  # disabled
multiplication_23 = Multiplication(A=[bang_2.Branch0, bang_2.Branch2, bang_2.Branch3, bang_2.Branch4, bang_2.Branch5], B=cost_of_electricity_kwh)  # disabled
data_2 = Data([multiplication_22, multiplication_23])  # disabled
ma_16 = MassAddition(Input=data_2)  # -> flatten(Result), PartialResults; disabled
annual_utility_cost_m2 = Panel(ma_16.Result)  # disabled
ma_17 = MassAddition(Input=annual_utility_cost_m2)  # -> Result, PartialResults; disabled
annual_utility_cost_m2_2 = Panel(ma_17.Result)  # disabled

eui_kbtu_ft2 = Number(eui_ip_kbtu_ft2)  # disabled

electric_lighting_kwh = Number(item_55.Item2)  # disabled
electric_equipment_kwh = Number(item_55.Item3)  # disabled
cooling_electric_kwh = Number(item_55.Item)  # disabled
fan_electric_kwh = Number(item_55.Item4)  # disabled
pump_electric_kwh = Number(item_55.Item5)  # disabled
heating_fuel_mbtu = Number(item_55.Item1)  # disabled

wh2btu_8 = Ladybug_Wh2BTU(Wh=selectandaveragedata_3.totaledMonthly)  # -> BTU; disabled; plug-in component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
strnum_12 = Ladybug_SeparateData(inputList=flatten(wh2btu_8))  # -> numbers, strings; disabled; plug-in component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
division_26 = Division(A=strnum_12.numbers, B=10.76)  # disabled
merge_19 = Merge(Data1=strnum_12.strings, Data2=division_26)  # disabled
data_3 = Data(merge_19)  # disabled

ma_18 = MassAddition(Input=strnum_2.numbers)  # -> flatten(Result), PartialResults; disabled
ma_19 = MassAddition(Input=strnum_3.numbers)  # -> flatten(Result), PartialResults; disabled
eui_si_kwh_m2 = Panel(ma_19.Result)  # disabled
ma_20 = MassAddition(Input=eui_si_kwh_m2)  # -> Result, PartialResults; disabled
eui_si_kwh_m2_2 = Panel(ma_20.Result)  # disabled

multiplication_24 = Multiplication(A=ma_18.Result, B=normalized_dataplenum_bug_fix_factor)  # disabled

eui_ip_kbtu_ft2_2 = Panel(multiplication_24)  # disabled
ma_21 = MassAddition(Input=eui_ip_kbtu_ft2_2)  # -> Result, PartialResults; disabled
eui_ip_kbtu_ft2_3 = Panel(ma_21.Result)  # disabled

multiplication_25 = Multiplication(A=multiplication_24, B=179776)  # disabled
key_4 = Panel(multiplication_25)  # disabled

barchart_3 = Ladybug_MonthlyBarChart(
    inputData=flatten(data_3),
    stackValues=toggle_7,
    altYAxisTitle=panel_47,
    basePoint=pt_4,
    yScale=panel_48,
    legendPar=legendpar_3)  # -> readMe, dataMesh, dataCurves, dataCrvColors, graphAxes, graphLabels, title, titleBasePt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; disabled; plug-in component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

medges_2 = MeshEdges(Mesh=barchart_3.dataMesh)  # -> NakedEdges, InteriorEdges, NonManifoldEdges; disabled

preview_9 = CustomPreview(Geometry=[medges_2.NakedEdges, medges_2.InteriorEdges], Shader=swatch_36)  # disabled
